# Grasshopper definition 038_robot_playground_ur5.ghx (Grasshopper 1.0.7)

reload = Button()

units = ValueList({"m": 1, "cm": 100, "mm": 1000}, selected="m")
panel = Panel("Load robot")
load = Button()
create = PythonScript(scale_factor=units, load=load)  # -> robot
# ---------- create: Python ----------
import os
from scriptcontext import sticky as st

import compas
from compas_fab.backends import RosClient
from compas_ghpython.artists import RobotModelArtist

compas.PRECISION = '12f'

# store robot in component
guid = str(ghenv.Component.InstanceGuid)
robot_key = "robot_" + guid

if robot_key not in st:
    st[robot_key] = None

if load:
    with RosClient() as ros:
        robot = ros.load_robot(load_geometry=True)
        robot.artist = RobotModelArtist(robot.model)

    st[robot_key] = robot
    robot.scale(scale_factor)

robot = st[robot_key]
# ---------- end create ----------
robot = Data(create)

# ---- group: ROS client
disconnect = Button()
restart = Button()
connect = Button()
ros = PythonScript(ip="127.0.0.1", restart=restart)  # -> out, ros_client
# ---------- ros: Python ----------
import sys
import time
import logging
import scriptcontext as sc

from compas_fab.backends import RosClient

from System import TimeSpan
from System.Threading import ManualResetEventSlim

LOGGER = logging.getLogger('roslibpy')

key = 'rosclient_%s' % str(ghenv.Component.InstanceGuid)
previous_client = sc.sticky.get(key, None)
if previous_client:
    previous_client.terminate()

ros_client = RosClient('localhost', 9090)
sc.sticky[key] = ros_client

waitLock = ManualResetEventSlim(False)

ros_client.on_ready(lambda: waitLock.Set())

if not waitLock.Wait(TimeSpan.FromSeconds(5)):
    raise Exception('Unable to connect to ROS')

LOGGER.info('ROS connection opened')
# ---------- end ros ----------
connect_2 = PythonScript(ros_client=ros.ros_client, connect=connect, disconnect=disconnect)  # -> out, ros_client
# ---------- connect_2: Python ----------
import logging
from System import TimeSpan
from System.Threading import ManualResetEventSlim

LOGGER = logging.getLogger('roslibpy')

if connect:
    if not ros_client.is_connected:
        LOGGER.debug('Connecting...')
        waitLock = ManualResetEventSlim(False)
        ros_client.on_ready(lambda: waitLock.Set())
        ros_client.connect()

        if not waitLock.Wait(TimeSpan.FromSeconds(5)):
            raise Exception('Unable to connect to ROS')
        LOGGER.debug('Reconnected')

if disconnect:
    if ros_client.is_connected:
        ros_client.terminate()
        LOGGER.debug('Terminated')

print ros_client.is_connected
# ---------- end connect_2 ----------
is_connected = Panel(connect_2.out)

# ----
py = PythonScript(reload=reload)
# ---------- py: Python ----------
from compas_rhino.utilities.misc import get_tolerance
from compas_rhino.utilities.misc import unload_modules

from compas_ghpython import unload_modules
unload_modules("compas")
unload_modules("compas_fab")
unload_modules("roslibpy")
# ---------- end py ----------

# ----
# Robot
set = PythonScript(robot=robot, client=connect_2.ros_client)
# ---------- set: Python ----------
if robot and client:
    robot.client = client
# ---------- end set ----------

# ----
# Info
info = PythonScript(robot=robot)  # -> out, main_group_name
# ---------- info: Python ----------
if robot:
    robot.info()
    main_group_name = robot.main_group_name
# ---------- end info ----------
panel_2 = Panel(info.out)

list = ValueList({"don't use attached collision mesh": 0, "use attached collision mesh": 1}, selected="don't use attached collision mesh")
list_2 = ValueList({"don't use attached collision mesh": 0, "use attached collision mesh": 1}, selected="use attached collision mesh")
list_3 = ValueList({"RRT", "RRT*": "RRTStar", "EST", "PRM": "RPM", "PRM*": "RPMStar", "SPARS"}, selected="RRT")

# ----
# Planning scene
# Pass collision objects to planning scene
scene = PythonScript(robot=robot)  # -> scene
# ---------- scene: Python ----------
from scriptcontext import sticky as st

from compas_fab.robots import PlanningScene

# store scene in component
guid = str(ghenv.Component.InstanceGuid)
scene_key = "scene_" + guid

if scene_key not in st:
    st[scene_key] = None

if robot:
    st[scene_key] = PlanningScene(robot)

scene = st[scene_key]
# ---------- end scene ----------

# ----
# Attach an collision object
# Select link name to attach
yz = YZPlane(Origin=Point(0, 0, 0))
cone = Cone(Base=yz, Radius=0.035, Length=0.1)  # -> Cone, Tip
mesh = Mesh(cone.Cone)
mesh_2 = PythonScript(mesh=mesh)  # -> compas_mesh
# ---------- mesh_2: Python ----------
from compas.datastructures import Mesh
from compas_rhino.helpers import mesh_from_guid

compas_mesh = mesh_from_guid(Mesh, mesh)
# ---------- end mesh_2 ----------
py_2 = PythonScript(robot=robot, idx=Slider(7, range=0..7))  # -> link_name; inputs idx: Int32
# ---------- py_2: Python ----------
if robot:
    link_names = robot.get_link_names()
    link_name = link_names[idx]
# ---------- end py_2 ----------
panel_3 = Panel(py_2)
remove = Button()
scale = BooleanToggle(False)
add = Button()
attached = PythonScript(scene=scene, compas_mesh=mesh_2, scale=scale, id="tip", link_name=py_2, add=add, remove=remove)  # -> acm; inputs touch_links: list
# ---------- attached: Python ----------
from compas_fab.robots import CollisionMesh
from compas_fab.robots import AttachedCollisionMesh

cm = CollisionMesh(compas_mesh, id)
acm = AttachedCollisionMesh(cm, link_name, touch_links)

if scene:
    if add:
        scene.add_attached_collision_mesh(acm, scale)
    if remove:
        scene.remove_attached_collision_mesh(id)
        scene.remove_collision_mesh(id)
# ---------- end attached ----------

panel_4 = Panel("Define an obstacle")
brep = Brep(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)
mesh_3 = Mesh(brep)
preview = CustomPreview(Geometry=brep, Shader=ColourSwatch(SwatchColor=RGB(255, 255, 255)))
mesh_4 = PythonScript(mesh=mesh_3)  # -> compas_mesh; same code as mesh_2
remove_2 = Button()
scale_2 = BooleanToggle(False)
add_2 = Button()
collision = PythonScript(scene=scene, compas_mesh=mesh_4, scale=scale_2, id="box", add=add_2, remove=remove_2)  # -> out
# ---------- collision: Python ----------
from compas_fab.robots import CollisionMesh

cm = CollisionMesh(compas_mesh, id)

if scene:
    if add:
        scene.add_collision_mesh(cm, scale)
    if remove:
        scene.remove_collision_mesh(id)
# ---------- end collision ----------
panel_5 = Panel(collision)

acms = Data(attached)

filter = StreamFilter(Gate=list, Stream1=attached)
filter_2 = StreamFilter(Gate=list_2, Stream1=acms)

# ---- group: plan motion
# If you specify the tolerance vector with [360, 1, 1], it means that
#     the frame's y-axis and z-axis are allowed to rotate about the x-axis by an
#     angle of 360 degrees, whereas the x-axis can only change 1 degree.
number_slider = Slider(1, range=1..360)
# Plan motion
number_slider_2 = Slider(0.001, range=0..0.001)
py_3 = PythonScript(robot=robot)  # -> configuration
# ---------- py_3: Python ----------
from compas_fab.robots import Configuration

if robot:
    types = robot.get_configurable_joint_types()
    values = [0] * len(types)

    configuration = Configuration(values, types)
    print configuration
# ---------- end py_3 ----------
list_4 = ValueList({"0", "1"}, selected="0")
panel_6 = Panel("positions")
panel_7 = Panel("velocities")
panel_8 = Panel("accelerations")

# ----
# Configuration
# TODO Example:
# Add path constraints
main_planning_group = Text(info.main_group_name)
compute = Button()

# ---- group: inverse kinematics
py_4 = PythonScript(robot=robot)  # -> configuration
# ---------- py_4: Python ----------
from compas_fab.robots import Configuration

if robot:
    types = robot.get_configurable_joint_types()
    values = [0] * len(types)
    values = [-0.042, 4.295, -4.110, -3.327, 4.755, 0.]

    configuration = Configuration(values, types)
    print configuration
# ---------- end py_4 ----------
pt = Point(Point(0.3999214321, 0.2442203562, 0.5417311015))
xy = XYPlane(Origin=pt)
ik = PythonScript(robot=robot, group=main_planning_group, start_configuration=py_4, plane=xy)  # -> out, configuration
# ---------- ik: Python ----------
import scriptcontext as sc
import logging

from compas.geometry import Frame

from compas_fab.backends.ros import RosError
from compas_fab.robots import Configuration

LOGGER = logging.getLogger('roslibpy')

if robot:
    if robot.client:
        if robot.client.is_connected:
            frame = Frame(plane.Origin, plane.XAxis, plane.YAxis)
            configuration = robot.inverse_kinematics(frame, start_configuration, group)
            print(configuration)
        else:
            print("Robot is not connected")
# ---------- end ik ----------
panel_9 = Panel(ik.out)

# ---- group: forward kinematics
a1 = Slider(0, range=-360..360)
a5 = Slider(0, range=-360..360)
a6 = Slider(0, range=-360..360)
a2 = Slider(0, range=-360..360)
a4 = Slider(0, range=-360..360)
a3 = Slider(0, range=-360..360)
set_joint_positions = BooleanToggle(False)
jp = GhPythonScript()  # -> joint_positions
# ---------- jp: Python ----------
import math
joint_positions = [-3.136, -0.328, -1.218, 3.129, 0.852, 0.008]
joint_positions = [0] * 6
print joint_positions
# ---------- end jp ----------
forward_kinematics = PythonScript(
    robot=robot,
    group=main_planning_group,
    set_joint_positions=set_joint_positions,
    joint_positions=jp,
    a1=a1,
    a2=a2,
    a3=a3,
    a4=a4,
    a5=a5,
    a6=a6)  # -> configuration; inputs joint_positions: list
# ---------- forward_kinematics: Python ----------
import math
import Grasshopper
from compas_fab.robots import Configuration

if set_joint_positions:

    j = 0
    for i in range(ghenv.Component.Params.Input.Count):
        nslider = ghenv.Component.Params.Input[i].Sources[0]
        if nslider.GetType() == Grasshopper.Kernel.Special.GH_NumberSlider:
            nslider.TrySetSliderValue(math.degrees(joint_positions[j]))
            j += 1

if robot:
    joint_positions = [a1, a2, a3, a4, a5, a6]
    joint_positions = [math.radians(a) for a in joint_positions]
    types = robot.get_configurable_joint_types(group)
    configuration = Configuration(joint_positions, types)
    print configuration
# ---------- end forward_kinematics ----------

fk = PythonScript(robot=robot, group=main_planning_group, configuration=ik.configuration)  # -> out, frame_WCF
# ---------- fk: Python ----------
import scriptcontext as sc
import logging
import Rhino

from compas_fab.robots import Configuration

LOGGER = logging.getLogger('roslibpy')

configuration = robot.get_group_configuration(group, configuration)
frame_RCF = robot.forward_kinematics(configuration, group, backend='model')
frame_WCF = robot.to_world_coordinates(frame_RCF, group)

print frame_WCF
# ---------- end fk ----------
panel_10 = Panel(fk.out)

# ---- group: cartesian motion
# Plan cartesian motion
pt_2 = Point(Point(0.1991236217, 0.38, 0.4465477747))
py_5 = PythonScript(robot=robot)  # -> configuration; same code as py_3
start_configuration = Data(ik.configuration)
list_5 = ValueList({"0", "1"}, selected="0")
avoid_collisions = BooleanToggle(True)
compute_2 = Button()
filter_3 = StreamFilter(Gate=list_5, Stream0=start_configuration, Stream1=py_5)

# ----
xy_2 = XYPlane(Origin=pt_2)

# ---- group: cartesian motion (continued)
py_6 = PythonScript(start_plane=xy, end_plane=xy_2)  # -> planes
# ---------- py_6: Python ----------
planes = [start_plane, end_plane]
print planes
# ---------- end py_6 ----------
plan_cartesian_motion = PythonScript(
    robot=robot,
    start_configuration=filter_3,
    planes=py_6,
    max_step=Slider(0.01, range=0..0.01),
    avoid_collisions=avoid_collisions,
    compute=compute_2,
    acm=filter)  # -> out, response; inputs planes: list, avoid_collisions: Boolean, acm: list
# ---------- plan_cartesian_motion: Python ----------
import logging
import scriptcontext as sc

from compas.geometry import Frame

from compas_ghpython.utilities import update_component

guid = str(ghenv.Component.InstanceGuid)
response_key = "response_" + guid
if response_key not in sc.sticky:
    sc.sticky[response_key] = None

LOGGER = logging.getLogger('roslibpy')
data = dict(requesting_solution=False)



if robot:
    if robot.client:
        if robot.client.is_connected:
            if start_configuration and compute:
                frames = [Frame(plane.Origin, plane.XAxis, plane.YAxis) for plane in planes]
                response = robot.plan_cartesian_motion(frames, start_configuration=start_configuration,
                                             max_step=float(max_step),
                                             avoid_collisions=bool(avoid_collisions),
                                             group=group,
                                             attached_collision_meshes=list(acm))
                sc.sticky[response_key] = response
                # update_component(ghenv, 100)  # Not needed now that it is sync?
        else:
            print("Robot is not connected")
            sc.sticky[response_key] = None

response = sc.sticky[response_key]
# ---------- end plan_cartesian_motion ----------
vis = PythonScript(response=plan_cartesian_motion.response)  # -> P, V, A
# ---------- vis: Python ----------
from compas_ghpython import list_to_ghtree

if response:

    positions = []
    velocities = []
    accelerations = []

    for p in response.points:
        positions.append(p.positions)
        velocities.append(p.velocities)
        accelerations.append(p.accelerations)

    P = list_to_ghtree(list(zip(*positions)))
    V = list_to_ghtree(list(zip(*velocities)))
    A = list_to_ghtree(list(zip(*accelerations)))
# ---------- end vis ----------
py_7 = PythonScript(response=plan_cartesian_motion.response)  # -> start_configuration, configurations, fraction, time
# ---------- py_7: Python ----------
from compas_fab.backends.ros import MoveItErrorCodes

joint_positions = []

if response:
    #if response.error_code == MoveItErrorCodes.SUCCESS:
    configurations = response.points
    start_configuration = response.start_configuration
    fraction = response.fraction
    time = response.time_from_start
# ---------- end py_7 ----------
fraction = Panel(py_7.fraction)
panel_14 = Panel(plan_cartesian_motion.out)
time_s = Panel(py_7.time)
prismatic = QuickGraph(vis.P, SortOrder=0)
animate = PythonScript(
    robot=robot,
    start_configuration=py_7.start_configuration,
    configurations=py_7.configurations,
    value=Slider(0, range=0..1))  # -> configuration; inputs configurations: list
# ---------- animate: Python ----------
from compas_fab.utilities import map_range
from compas_fab.robots import Configuration

count = len(configurations)
if count and robot and configurations[0] != None:
    idx = int(map_range(value, 0, 1, 0, count - 1))
    current_configuration = configurations[idx]
    #make full configuration
    configuration = robot.merge_group_with_full_configuration(current_configuration, start_configuration, group)
# ---------- end animate ----------
graph = QuickGraph(vis.V, SortOrder=0)
graph_2 = QuickGraph(vis.A, SortOrder=0)

# ---- group: plan motion (continued)
python = PythonScript(
    robot=robot,
    group=main_planning_group,
    goal_plane=xy_2,
    tolerance_position=number_slider_2,
    tolerance_xaxis_deg=Slider(360, range=1..360),
    tolerance_yaxis_deg=Slider(1, range=1..360),
    tolerance_zaxis_deg=number_slider)  # -> goal_constraints
# ---------- python: Python ----------
import math
from compas.geometry import Frame

frame = Frame(goal_plane.Origin, goal_plane.XAxis, goal_plane.YAxis)

tolerances_axes = [math.radians(tolerance_xaxis_deg), math.radians(tolerance_yaxis_deg), math.radians(tolerance_zaxis_deg)]

if robot:
    goal_constraints = robot.constraints_from_frame(frame, tolerance_position, tolerances_axes, group)
# ---------- end python ----------
start_configuration_2 = Data(ik.configuration)
filter_4 = StreamFilter(Gate=list_4, Stream0=start_configuration_2, Stream1=py_3)

# ----
plan_motion = PythonScript(robot=robot, start_configuration=filter_4, goal_constraints=python, planner_id=list_3, compute=compute, acm=filter_2)  # -> out, response; inputs goal_constraints: list, path_constraints: list, acm: list
# ---------- plan_motion: Python ----------
import logging
from scriptcontext import sticky as st
import math
from compas.geometry import Frame

from compas_fab.robots import Configuration

from compas_ghpython.utilities import update_component

guid = str(ghenv.Component.InstanceGuid)
response_key = "response_" + guid
if response_key not in st:
    st[response_key] = None

LOGGER = logging.getLogger('roslibpy')
data = dict(requesting_solution=False)

path_constraints = list(path_constraints)
if not len(path_constraints):
    path_constraints = None

if robot and robot.client and robot.client.is_connected and start_configuration and compute:
    st[response_key] = robot.plan_motion(goal_constraints,
                                         start_configuration,
                                         group,
                                         planner_id=str(planner_id),
                                         path_constraints=path_constraints,
                                         attached_collision_meshes=list(acm))

response = st[response_key]
# ---------- end plan_motion ----------
py_8 = PythonScript(robot=robot, response=plan_motion.response)  # -> start_configuration, configurations, error
# ---------- py_8: Python ----------
from compas_fab.backends.ros import MoveItErrorCodes
from compas_fab.robots import Configuration
joint_positions = []

if response:
    #if response.error_code == MoveItErrorCodes.SUCCESS:
    print response.start_configuration
    print response.planning_time

    configurations = response.points
    start_configuration = response.start_configuration
    #error = response.error_code.human_readable




print start_configuration
# ---------- end py_8 ----------
error = Panel(py_8.error)
panel_15 = Panel(plan_motion.out)
animate_2 = PythonScript(
    robot=robot,
    start_configuration=py_8.start_configuration,
    configurations=py_8.configurations,
    value=Slider(0, range=0..1))  # -> configuration; inputs configurations: list; same code as animate

# ---- group: plan motion (continued)
vis_2 = PythonScript(response=plan_motion.response)  # -> P, V, A, time
# ---------- vis_2: Python ----------
from compas_ghpython import list_to_ghtree

if response:

    positions = []
    velocities = []
    accelerations = []
    time_from_start = []

    for p in response.points:
        positions.append(p.positions)
        velocities.append(p.velocities)
        accelerations.append(p.accelerations)
        time_from_start.append(p.time_from_start.seconds)

    P = list_to_ghtree(list(zip(*positions)))
    V = list_to_ghtree(list(zip(*velocities)))
    A = list_to_ghtree(list(zip(*accelerations)))

    time = time_from_start[-1]
    print time
# ---------- end vis_2 ----------
time_s_2 = Panel(vis_2.time)
prismatic_2 = QuickGraph(vis_2.P, SortOrder=0)
graph_3 = QuickGraph(vis_2.V, SortOrder=0)
graph_4 = QuickGraph(vis_2.A, SortOrder=0)

# ----
# Visualisation
# Select configuration input: from fk, ik, path, or from real robot
list_6 = ValueList({"0 forward_kinematics": 0, "1 inverse_kinematics": 1, "2 cartesian path": 2, "3 kinematic path": 3}, selected="0 forward_kinematics")
filter_5 = StreamFilter(Gate=list_6, Stream0=forward_kinematics, Stream1=ik.configuration, Stream2=animate, Stream3=animate_2)
show_end_effector_frame = BooleanToggle(True)
show_base_frame = BooleanToggle(False)
show_collision = BooleanToggle(False)
show_frames = BooleanToggle(True)
show_visual = BooleanToggle(True)
show_acm = BooleanToggle(True)
visualize = PythonScript(
    robot=robot,
    configuration=filter_5,
    show_visual=show_visual,
    show_collision=show_collision,
    show_frames=show_frames,
    show_base_frame=show_base_frame,
    show_end_effector_frame=show_end_effector_frame)  # -> out, visual, collision, frames, frames_color, ee_plane, ee_frame, ee_frame_geo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
# ---------- visualize: Python ----------
from System.Drawing import Color

from compas.geometry import Vector
from compas.geometry import Point
from compas_ghpython.utilities import draw_frame
from compas_ghpython.utilities import draw_pipes

from compas_fab.robots import Configuration

red = Color.FromArgb(255, 0, 0)
green = Color.FromArgb(0, 255, 0)
blue = Color.FromArgb(0, 0, 255)

frame_colors = [red, green, blue]

# TODO: move to frame artist?
def pipes_from_frame(frame, size, radius):
    pipes = []
    for axis in [frame.xaxis, frame.yaxis, frame.zaxis]:
        pipe = {}
        pipe['points'] = [list(frame.point), list(Point(*frame.point) + Vector(*axis) * size)]
        pipe['radius'] = radius
        pipes.append(pipe)
    return pipes

if robot and configuration:
    
    robot.update(configuration, visual=show_visual, collision=show_collision)

    print("Configuration:")
    print(configuration.values)

    if show_visual:
        visual = robot.draw_visual()

    if show_collision:
        collision = robot.draw_collision()

    pipe_size = 0.1 * robot.scale_factor
    pipe_radius = 0.001 * robot.scale_factor


    axes = robot.transformed_axes(configuration)

    frames = robot.transformed_frames(configuration)

    if show_frames:

        pipes = []
        frames_color = []
        for frame in frames:
            pipes += pipes_from_frame(frame, pipe_size, pipe_radius)
            frames_color += frame_colors
        frames = draw_pipes(pipes, cap=1)

    ee_frame_RCF = robot.forward_kinematics(configuration, options=dict(solver='model'))
    ee_frame = robot.to_world_coordinates(ee_frame_RCF)
    ee_plane = draw_frame(ee_frame)

    print("End-effector frame:")
    print(ee_frame)

    if show_end_effector_frame:
        ee_pipes = pipes_from_frame(ee_frame, pipe_size, pipe_radius)
        ee_frame_geo = draw_pipes(ee_pipes, cap=1)
        ee_frame_color = frame_colors

    base_frame = robot.get_base_frame()
    base_plane = draw_frame(base_frame)

    if show_base_frame:
        base_pipes = pipes_from_frame(base_frame, pipe_size, pipe_radius)
        base_frame_geo = draw_pipes(base_pipes, cap=1)
        base_frame_color = frame_colors
# ---------- end visualize ----------
visualize_2 = GhPythonScript(acms=acms, robot=robot, configuration=filter_5, show=show_acm)  # -> M; inputs acms: list
# ---------- visualize_2: Python ----------
from compas_ghpython.artists import MeshArtist
from compas.datastructures import mesh_transformed
from compas.geometry import Transformation, Frame

M = []

if show:

    for acm in acms:
        
        """
        # why is this not working...
        for group in robot.group_names:
            if acm.link_name in robot.get_link_names(group):
                break
        frame = robot.forward_kinematics(configuration, group=group, backend="model", link_name=acm.link_name)
        T = Transformation.from_frame_to_frame(Frame.worldXY(), frame)
        mesh = mesh_transformed(acm.collision_mesh.mesh, T)
        M.append(MeshArtist(mesh).draw_mesh()) 
        """
        
        link = robot.model.get_link_by_name(acm.link_name)
        T0 = Transformation.from_frame_to_frame(Frame.worldXY(), link.parent_joint.origin)
        
        joint_names = robot.get_configurable_joint_names()
        joint_state = dict(zip(joint_names, configuration.values))
        transformations = robot.model.compute_transformations(joint_state)
    
        for j in robot.model.iter_joints():
            if j.child_link.name == acm.link_name:
                T = transformations[j.name]
                compas_mesh = acm.collision_mesh.mesh
                mesh = mesh_transformed(compas_mesh, T * T0)
                M.append(MeshArtist(mesh).draw_mesh())
                break
# ---------- end visualize_2 ----------
preview_2 = CustomPreview(Geometry=visualize_2, Shader=ColourSwatch(SwatchColor=RGB(255, 255, 255)))
preview_3 = CustomPreview(Geometry=visualize.ee_frame_geo, Shader=visualize.ee_frame_color)
preview_4 = CustomPreview(Geometry=visualize.base_frame_geo, Shader=visualize.base_frame_color)
preview_5 = CustomPreview(Geometry=visualize.frames, Shader=visualize.frames_color)
geo = Geometry(visualize.visual)
geo_2 = Geometry(visualize.collision)
panel_16 = Panel(visualize.out)

preview_6 = CustomPreview(Geometry=geo, Shader=ColourSwatch(SwatchColor=RGB(105, 105, 105)))
