# Grasshopper definition 050_robot_assembly_updated.ghx (Grasshopper 1.0.7)

brep = Brep(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)
brep_2 = Brep(<brep referenced from the Rhino model>)
mesh = Mesh([brep, brep_2])
brep_3 = Brep(<brep referenced from the Rhino model>)
mjoin = MeshJoin(Meshes=mesh)
mesh_2 = Mesh(brep_3)
mesh_3 = PythonScript(mesh=mjoin)  # -> compas_mesh
# ---------- mesh_3: Python ----------
from compas_rhino.geometry import RhinoMesh

compas_mesh = RhinoMesh.from_geometry(mesh).to_compas()
# ---------- end mesh_3 ----------
remove = Button()
scale = BooleanToggle(False)
add = Button()
reload = Button()
py = GhPythonScript()  # -> workshop_path, DATA
# ---------- py: Python ----------
import os
import sys

filepath = ghenv.Component.Attributes.Owner.OnPingDocument().FilePath
workshop_path = os.path.abspath(os.path.join(filepath, "..", ".."))
print(workshop_path)

DATA = os.path.abspath(os.path.join(workshop_path, "data"))

# add assembly to sys
sys.path.append(os.path.join(workshop_path, "examples"))
# ---------- end py ----------

# ---- group: ROS client
# Robot
disconnect = Button()
connect = Button()
connect_2 = PythonScript(ip="127.0.0.1", connect=connect, disconnect=disconnect)  # -> out, ros_client
# ---------- connect_2: Python ----------
import sys
import scriptcontext as sc
from compas_fab.backends import RosClient

key = 'rosclient_%s' % str(ghenv.Component.InstanceGuid)
previous_client = sc.sticky.get(key, None)

if previous_client and (connect or disconnect):
    previous_client.close()

if connect:
    ros_client = RosClient(ip, 9090)
    sc.sticky[key] = ros_client
    ros_client.run(5)

ros_client = sc.sticky.get(key, None)
print('ROS connected: {}'.format(ros_client.is_connected if ros_client else 'False'))
# ---------- end connect_2 ----------
is_connected = Panel(connect_2.out)

# ----
# Load robot from ROS
units = ValueList({"m": 1, "cm": 100, "mm": 1000}, selected="m")
load = Button()
create = PythonScript(ros_client=connect_2.ros_client, scale_factor=units, load=load)  # -> robot
# ---------- create: Python ----------
import os
from scriptcontext import sticky as st
import compas
from compas.robots import RobotModel
from compas_fab.backends import RosClient
from compas_fab.backends import RosFileServerLoader
from compas_fab.robots import Robot
from compas_fab.robots import RobotSemantics
from compas_ghpython.artists import RobotModelArtist

# Set high precision to import meshes defined in meters
compas.PRECISION = '24f'

# store robot in component
guid = str(ghenv.Component.InstanceGuid)
robot_key = "robot_" + guid

if robot_key not in st:
    st[robot_key] = None

if ros_client and ros_client.is_connected and load:
    # Load URDF from ROS
    loader = RosFileServerLoader(ros_client)
    urdf = loader.load_urdf()
    srdf = loader.load_srdf()

    # Create robot model from URDF and load geometry
    model = RobotModel.from_urdf_string(urdf)
    model.load_geometry(loader)

    semantics = RobotSemantics.from_srdf_string(srdf, model)

    robot = Robot(model, semantics=semantics)
    robot.artist = RobotModelArtist(robot.model)
    robot.scale(scale_factor)
    st[robot_key] = robot

robot = st[robot_key]
if robot:
    robot.client = ros_client
# ---------- end create ----------
robot = Data(create)

# ----
# Element
# Predefine an element and its dimensions
# Visualise the defined element
show = BooleanToggle(True)
# Ex1
elem_def = GhPythonScript()  # -> out, elem
# ---------- elem_def: Python ----------
import os
import sys
import json

from compas.geometry import Frame
from compas.geometry import Vector
from compas.geometry import Box

from assembly_information_model.assembly import Element

# dimensions
width = 0.020
length = 0.23
height = 0.005

# element
box_frame = Frame([0., 0., height/2.], [1, 0, 0], [0, 1, 0]) #center of the box frame 
box = Box(box_frame, length, width, height) 
tool_frame = Frame([0, 0, height], [1, 0, 0], [0, 1, 0])
elem = Element.from_shape(box, tool_frame)
elem._tool_frame = tool_frame
# ---------- end elem_def ----------
draw = PythonScript(elem=elem_def.elem, show=show)  # -> M, F, S
# ---------- draw: Python ----------
from compas.geometry import Transformation
from compas.geometry import Frame
from compas.datastructures import mesh_transformed
from compas_ghpython.artists import MeshArtist
from compas_ghpython import draw_frame

if show:
    artist = MeshArtist(elem.mesh)
    M = artist.draw()
    F = draw_frame(elem.frame)
    S = draw_frame(elem._source.frame)
# ---------- end draw ----------

py_2 = PythonScript(reload=reload)
# ---------- py_2: Python ----------
import os
import sys
from compas_rhino.utilities.misc import get_tolerance
from compas_rhino.utilities.misc import unload_modules

from compas_ghpython import unload_modules
unload_modules("compas")
unload_modules("compas_fab")
unload_modules("roslibpy")
unload_modules("assembly")
# ---------- end py_2 ----------
panel = Panel(py.workshop_path)
panel_2 = Panel(py.DATA)
cp = Plane(Plane(origin=(0.8124568443, 0, -0.4646184479), x=(-1, 0, 0), y=(0, -1, 0)))

# ----
# Assembly
generate_assembly = GhPythonScript(centerplane=cp, elem=elem_def.elem)  # -> assembly, planes
# ---------- generate_assembly: Python ----------
import math
from scriptcontext import sticky as st

from compas.geometry import Frame
from compas.geometry import Transformation
from compas.geometry import Rotation
from compas.geometry import Translation
from compas.geometry import Point

from compas_ghpython import draw_frame

from assembly_information_model.assembly import Assembly
from assembly_information_model.assembly import Element

# initialize an empty assembly clas
assembly = Assembly()

planes = [] # just for vizualisation

cp = centerplane
cf = Frame(cp.Origin, cp.XAxis, cp.YAxis)

for i in range(25): # loop through the number of layers i
    
    axis = cf.zaxis
    angle = math.radians(i*3)
    
    R = Rotation.from_axis_and_angle(axis, angle, point=cp.Origin) #Calculates a ``Rotation`` from a rotation axis and an angle and an optional point of rotation.
    T = Translation.from_vector([0,0,0.005*i])

    cft = cf.transformed(R * T) #transforms the origin plane

    if i%2 == 0: 
        R = Rotation.from_axis_and_angle(cft.zaxis, math.radians(90), point=cft.point)
        cft = cft.transformed(R)
       
    add = math.sin(i/5)*0.015
    #print(add)
    
    o1 = cft.point + cft.yaxis*(0.075+add)
    o2 = cft.point - cft.yaxis*(0.075+add)
    
    f1 = Frame(o1, cft.xaxis, cft.yaxis)
    f2 = Frame(o2, cft.xaxis, cft.yaxis)
    
    planes.append(draw_frame(f1))
    planes.append(draw_frame(f2))
    
    T1 = Transformation.from_frame_to_frame(Frame.worldXY(), f1)
    T2 = Transformation.from_frame_to_frame(Frame.worldXY(), f2)
    
    # create new instances of the element
    new_elem_1 = elem.transformed(T1) #returns a deep copy of the initial element at the new location of the frame
    new_elem_2 = elem.transformed(T2)

    assembly.add_element(new_elem_1)
    assembly.add_element(new_elem_2)
# ---------- end generate_assembly ----------
assembly = Data(generate_assembly.assembly)
pln = Plane(generate_assembly.planes)

# ----
# Info
info = PythonScript(robot=robot)  # -> out, main_group_name
# ---------- info: Python ----------
if robot:
    robot.info()
    main_group_name = robot.main_group_name
# ---------- end info ----------
panel_3 = Panel(info.out)

path = Data(panel)
data_path = Data(panel_2)

# ----
# Tool
panel_4 = Panel("Set a custom tool")
panel_5 = Panel("vacuum_gripper.json")
python = PythonScript(data_path=data_path, filename="airpick.json")  # -> tool, frame
# ---------- python: Python ----------
import os
from compas.geometry import Frame
from compas.datastructures import Mesh
from compas_ghpython.artists import MeshArtist
from compas_fab.robots import Tool

fullfilename = os.path.join(data_path, filename)
tool = Tool.from_json(fullfilename)
frame = tool.frame
# ---------- end python ----------
attach = BooleanToggle(True)
py_3 = PythonScript(robot=robot, tool=python.tool, attach=attach)
# ---------- py_3: Python ----------
if robot:
    if attach:
        robot.attach_tool(tool)
    else:
        robot.detach_tool()
# ---------- end py_3 ----------
draw_2 = GhPythonScript(frames=python.frame, scale=Slider(0.05, range=0..1))  # -> P, V, C, W; inputs frames: list
# ---------- draw_2: Python ----------
from System.Drawing import Color
from compas_ghpython.utilities import draw_frame

red = Color.FromArgb(255, 0, 0)
green = Color.FromArgb(0, 255, 0)
blue = Color.FromArgb(0, 0, 255)

P = []
V = []
C = []

scale = float(scale)

for frame in frames:
    if not frame:
        continue
    plane = draw_frame(frame)
    P += [plane.Origin] * 3
    V.append(plane.XAxis * scale)
    V.append(plane.YAxis * scale)
    V.append(plane.ZAxis * scale)
    C += [red, green, blue]

W = 3
# ---------- end draw_2 ----------
vdisex = VectorDisplayEx(Point=draw_2.P, Vector=draw_2.V, Colour=draw_2.C, Width=draw_2.W)

python_2 = GhPythonScript(assembly=assembly, data_path=data_path, filename="assembly.json", write=Toggle(True))  # -> out
# ---------- python_2: Python ----------
import os
from assembly_information_model.assembly import Assembly

if write:
    filepath = os.path.join(data_path, filename)
    assembly.to_json(filepath, pretty=True)
# ---------- end python_2 ----------

reset = Button()
back = Button()
stop = Button()
step = Button()
start = Button()
full = Button()
list = ValueList({"20", "50", "100", "500", "1000", "5000"}, selected="50")

# ----
# Draw
counter = CountThroughList(assembly=assembly, start=start, stop=stop, step=step, step_back=back, reset=reset, full=full, interval=list)  # -> item, counter; inputs start: Boolean, stop: Boolean, step_back: Boolean
# ---------- counter: Python ----------
from scriptcontext import sticky as st
from compas_ghpython import update_component


L = list(assembly.elements())
# store data in component
guid = str(ghenv.Component.InstanceGuid)
counter_key = "counter_" + guid
running_key = "running_" + guid

if counter_key not in st:
    st[counter_key] = 0

if running_key not in st:
    st[running_key] = False
    

if st[running_key]:
    if st[counter_key] < len(L) - 1:
        st[counter_key] += 1
        update_component(ghenv, interval)
    else:
        st[counter_key] = 0
        st[running_key] = False
    
    
if start:
    st[running_key] = True

if stop:
    st[running_key] = False

if step:
    if st[counter_key] < len(L) - 1:
        st[counter_key] += 1

if step_back:
    if st[counter_key] < len(L) - 1:
        st[counter_key] -= 1

if reset:
    st[counter_key] = 0

if full:
    st[counter_key] = len(L)-1

if len(L):
    item = L[st[counter_key]]



#st["visualisation_counter"] = st[counter_key]
counter = st[counter_key]
# ---------- end counter ----------
show_2 = BooleanToggle(True)
show_3 = BooleanToggle(True)
idx = Panel(counter.counter)
draw_3 = PythonScript(assembly=assembly, show_all=show_3, show_counter=show_2, counter=idx)  # -> G, tool_planes_WCS, current_tool_plane; inputs counter: Int32
# ---------- draw_3: Python ----------
import os
import sys

import math

from compas_ghpython.artists import MeshArtist
from compas_ghpython import draw_frame


G = []

key_index = assembly.network.key_index()
keys = [key_index[key] for key in assembly.network.nodes()]
elements = [assembly.element(key) for key in keys]

tool_planes_WCS = [draw_frame(e.tool_frame) for e in elements]

current_tool_plane = tool_planes_WCS[counter]

if show_all and not show_counter:
    for element in elements:
        artist = MeshArtist(element.mesh)
        mesh = artist.draw_mesh()
        G.append(mesh)

if show_counter:
    for element in elements[0:counter+1]:
        artist = MeshArtist(element.mesh)
        mesh = artist.draw()
        G.append(mesh)
    tool_planes_WCS = [draw_frame(e.tool_frame) for e in elements[0:counter+1]]
# ---------- end draw_3 ----------
geo = Geometry(draw_3.G)
pln_2 = Plane(draw_3.tool_planes_WCS)
pln_3 = Plane(draw_3.current_tool_plane)
preview = CustomPreview(Geometry=geo, Shader=ColourSwatch(SwatchColor=RGBA(255, 227, 227, 233)))
preview_2 = CustomPreview(Geometry=[pln_2, pln_3], Shader=ColourSwatch(SwatchColor=RGBA(209, 27, 27, 178)))

# ----
# Pick up location
pt = Point(Point(0.0625, -0.5825, -0.011))

tolerance_vector = Vector(Vector(0, 0, 0.001))
safelevel_vector = Vector(Vector(0, 0, 0.05))

# ----
# Step
number_slider = Slider(0, range=0..100)
python_3 = PythonScript(assembly=assembly, key=number_slider)  # -> out, element, M; inputs key: Int32
# ---------- python_3: Python ----------
from compas_ghpython.artists import MeshArtist


element = assembly.element(key)

artist = MeshArtist(element.mesh)
M = artist.draw()
# ---------- end python_3 ----------
element = Data(python_3.element)
preview_3 = CustomPreview(Geometry=python_3.M, Shader=ColourSwatch(SwatchColor=RGBA(255, 0, 0, 218)))

# ----
# 6. Load from planned assembly
panel_6 = Panel("047_plan_paths_assembly.json")
python_4 = GhPythonScript(data_path=data_path, filename=panel_6, read=Toggle(True))  # -> out, assembly, configurations
# ---------- python_4: Python ----------
import os
from assembly_information_model.assembly import Assembly

filepath = os.path.join(data_path, filename)

if os.path.isfile(filepath):
    assembly = Assembly.from_json(filepath)
    configurations = []
    for key in assembly.network.nodes():
        element = assembly.element(key)
        if element.trajectory:
            trajectory_points = []
            for trajectory in element.trajectory:
                trajectory_points += trajectory.points
            configurations += trajectory_points
            trajectory_points.reverse()
            configurations += trajectory_points
# ---------- end python_4 ----------

# ----
# Configuration
main_planning_group = Text(info.main_group_name)

# ---- group: cartesian motion
# 6. Save assembly to json
panel_7 = Panel("assembly_stack_planned.json")
save = Button()
python_5 = PythonScript(assembly=assembly, DATA=data_path, name=panel_7, save=save)  # -> out, a
# ---------- python_5: Python ----------
import os
filename = os.path.join(DATA, name)

print assembly.element(0)

if save:
    assembly.to_json(filename, pretty=True)
# ---------- end python_5 ----------

# ---- group: forward kinematics
a1 = Slider(-101, range=-360..360)
a6 = Slider(-191, range=-360..360)
a2 = Slider(-80, range=-360..360)
a4 = Slider(216, range=-360..360)
a5 = Slider(-90, range=-360..360)
a3 = Slider(134, range=-360..360)
set_joint_positions = BooleanToggle(True)
jp = GhPythonScript()  # -> joint_positions
# ---------- jp: Python ----------
import math
joint_positions = [-3.136, -0.328, -1.218, 3.129, 0.852, 0.008]
joint_positions = [0] * 6
#joint_positions = [-6.023, 4.448, -2.312, 5.718, 1.571, -2.882]
joint_positions = [-1.765, -1.395, 2.345, 3.762, -1.571, -3.336]
print joint_positions
# ---------- end jp ----------
forward_kinematics = PythonScript(
    robot=robot,
    group=main_planning_group,
    set_joint_positions=set_joint_positions,
    joint_positions=jp,
    a1=a1,
    a2=a2,
    a3=a3,
    a4=a4,
    a5=a5,
    a6=a6)  # -> configuration; inputs joint_positions: list
# ---------- forward_kinematics: Python ----------
import math
import Grasshopper
from compas_fab.robots import Configuration

if set_joint_positions:

    j = 0
    for i in range(ghenv.Component.Params.Input.Count):
        nslider = ghenv.Component.Params.Input[i].Sources[0]
        if nslider.GetType() == Grasshopper.Kernel.Special.GH_NumberSlider:
            nslider.TrySetSliderValue(math.degrees(joint_positions[j]))
            j += 1

if robot:
    joint_positions = [a1, a2, a3, a4, a5, a6]
    joint_positions = [math.radians(a) for a in joint_positions]
    types = robot.get_configurable_joint_types(group)
    configuration = Configuration(joint_positions, types)
    print configuration
# ---------- end forward_kinematics ----------

# ----
list_2 = ValueList({"RRT", "RRT*": "RRTStar", "EST", "PRM": "RPM", "PRM*": "RPMStar", "SPARS"}, selected="RRT")
reset_2 = Button()
start_2 = Button()
start_3 = Button()
stop_2 = Button()
reset_3 = Button()
counter_2 = CountThroughList(L=python_4.configurations, start=start_3, stop=stop_2, step=False, reset=reset_3, interval=1)  # -> item; inputs L: list, start: Boolean, stop: Boolean
# ---------- counter_2: Python ----------
from scriptcontext import sticky as st
from compas_ghpython.utilities import update_component

if not interval:
    interval = 5

# store data in component
guid = str(ghenv.Component.InstanceGuid)
counter_key = "counter_" + guid
running_key = "running_" + guid

if counter_key not in st or reset:
    st[counter_key] = 0

if running_key not in st:
    st[running_key] = False


    

if start:
    st[running_key] = True

if stop:
    st[running_key] = False

if step:
    if st[counter_key] < len(L) - 1:
        st[counter_key] += 1

if back:
    if st[counter_key] > 1:
        st[counter_key] -= 1

if len(L):
    item = L[st[counter_key]]

if st[running_key]:
    if st[counter_key] < len(L) - 1:
        st[counter_key] += 1
        update_component(ghenv, interval)
    else:
        st[counter_key] = 0
        st[running_key] = False
# ---------- end counter_2 ----------

# ----
# Setup Geometry
robot_table_collision = Brep(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)
assembly_table = Brep(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)
robot_table = Brep([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])
mesh_4 = Mesh(assembly_table)
preview_4 = CustomPreview(Geometry=[robot_table, assembly_table], Shader=ColourSwatch(SwatchColor=RGB(255, 255, 255)))

mesh_5 = Mesh(robot_table_collision)
mjoin_2 = MeshJoin(Meshes=[mesh_5, mesh_2])

mesh_6 = Mesh(mjoin_2)

# ----
# Planning scene
# Pass collision objects to planning scene
scene = PythonScript(robot=robot)  # -> scene
# ---------- scene: Python ----------
from scriptcontext import sticky as st

from compas_fab.robots import PlanningScene

# store scene in component
guid = str(ghenv.Component.InstanceGuid)
scene_key = "scene_" + guid

if scene_key not in st:
    st[scene_key] = None

if robot:
    st[scene_key] = PlanningScene(robot)

scene = st[scene_key]
# ---------- end scene ----------

collision = PythonScript(scene=scene, compas_mesh=mesh_3, scale=scale, id="wall", add=add, remove=remove)  # -> out
# ---------- collision: Python ----------
from compas_fab.robots import CollisionMesh

cm = CollisionMesh(compas_mesh, id)

if scene:
    if add:
        scene.add_collision_mesh(cm, scale)
    if remove:
        scene.remove_collision_mesh(id)
# ---------- end collision ----------

panel_8 = Panel("Define an obstacle")
mesh_7 = PythonScript(mesh=mesh_6)  # -> compas_mesh; same code as mesh_3
mesh_8 = PythonScript(mesh=mesh_4)  # -> compas_mesh; same code as mesh_3
remove_2 = Button()
remove_3 = Button()
scale_2 = BooleanToggle(False)
add_2 = Button()
scale_3 = BooleanToggle(False)
add_3 = Button()
collision_2 = PythonScript(scene=scene, compas_mesh=mesh_7, scale=scale_2, id="robot_table", add=add_2, remove=remove_2)  # -> out; same code as collision
collision_3 = PythonScript(scene=scene, compas_mesh=mesh_8, scale=scale_3, id="assembly_table", add=add_3, remove=remove_3)  # -> out; same code as collision
panel_9 = Panel(collision_2)
panel_10 = Panel(collision_3)

# ----
# Add or remove tool
remove_4 = Button()
add_4 = Button()
tool = PythonScript(scene=scene, add=add_4, remove=remove_4)  # -> out
# ---------- tool: Python ----------
if scene:
    if add:
        scene.add_attached_tool()
    if remove:
        scene.remove_attached_tool()
# ---------- end tool ----------

collision_meshes = Data([mesh_7, mesh_8])
collision_names = Data(["robot_table", "assembly_table"])

# ----
# Settings
python_6 = PythonScript(
    robot=robot,
    element0=elem_def.elem,
    data_path=data_path,
    picking_location=pt,
    safelevel_vector=safelevel_vector,
    tolerance_vector=tolerance_vector,
    collision_meshes=collision_meshes,
    collision_names=collision_names,
    current_element=element)  # -> element_acm, picking_configuration, picking_frame, picking_plane, safelevel_picking_frame, safelevel_target_frame, target_frame, picking_element_mesh; inputs collision_meshes: list, collision_names: list
# ---------- python_6: Python ----------
import os
import json

from compas.geometry import Frame
from compas.geometry import Vector, Point
from compas_fab.robots import Configuration
from compas.geometry import Transformation
from compas_ghpython.artists import MeshArtist
from compas_fab.robots import CollisionMesh, AttachedCollisionMesh
from compas_ghpython import draw_frame

if robot:

    settings_file = os.path.join(data_path, "settings.json")
    
    # convert
    tolerance_vector = Vector(*list(tolerance_vector))
    safelevel_vector = Vector(*list(safelevel_vector))
    
    # create attached collision object
    element0_tool0 = element0.copy()
    T = Transformation.from_frame_to_frame(element0_tool0._tool_frame, robot.attached_tool.frame)
    element0_tool0.transform(T)
    ee_link_name = robot.get_end_effector_link_name()
    element_acm = AttachedCollisionMesh(CollisionMesh(element0_tool0.mesh, 'brick'), ee_link_name)
    
    picking_configuration = Configuration.from_revolute_values((-1.765, -1.311, 2.365, 3.658, -1.571, -3.336))


    
    picking_frame = Frame(list(picking_location), Vector(1, 0, 0), Vector(0, 1, 0))
    
    data = {}
    data['picking_configuration'] = picking_configuration.data
    data['picking_frame'] = picking_frame.data
    data['tolerance_vector'] = tolerance_vector.data
    data['safelevel_vector'] = safelevel_vector.data
    data['element0'] = element0.data
    data['collision_meshes'] = [mesh.data for mesh in collision_meshes]
    data['collision_names'] = list(collision_names)
    
    with open(settings_file, 'w') as f:
        json.dump(data, f)
    
    safelevel_picking_frame = picking_frame.copy()
    brick_at_picking_frame = element0.transformed(Transformation.from_frame_to_frame(element0._tool_frame, picking_frame))
    picking_element_mesh = MeshArtist(brick_at_picking_frame.mesh).draw()
    
    picking_frame.point += tolerance_vector
    safelevel_picking_frame.point += safelevel_vector
    
    target_frame = current_element._tool_frame.copy()
    target_frame.point += tolerance_vector
    safelevel_target_frame = target_frame.copy()
    safelevel_target_frame.point += safelevel_vector
    
    picking_plane = draw_frame(picking_frame)
# ---------- end python_6 ----------
preview_5 = CustomPreview(Geometry=python_6.picking_element_mesh, Shader=ColourSwatch(SwatchColor=RGBA(201, 145, 71, 218)))
number_slider_2 = Slider(0.05, range=0..1)
draw_4 = GhPythonScript(frames=[python_6.picking_frame, python_6.safelevel_picking_frame], scale=number_slider_2)  # -> P, V, C, W; inputs frames: list; same code as draw_2
draw_5 = GhPythonScript(frames=[python_6.safelevel_target_frame, python_6.target_frame], scale=number_slider_2)  # -> P, V, C, W; inputs frames: list; same code as draw_2
vdisex_2 = VectorDisplayEx(Point=draw_4.P, Vector=draw_4.V, Colour=draw_4.C, Width=draw_4.W)
vdisex_3 = VectorDisplayEx(Point=draw_5.P, Vector=draw_5.V, Colour=draw_5.C, Width=draw_5.W)

pln_4 = Plane(python_6.picking_plane)

# ---- group: cartesian motion
# 1. 'Pick' cartesian motion
number_slider_3 = Slider(0.01, range=0..0.01)
python_7 = PythonScript(robot=robot, frames=[python_6.picking_frame, python_6.safelevel_picking_frame])  # -> frames_tool0; inputs frames: list
# ---------- python_7: Python ----------
from compas.geometry import Frame

if robot:
    frames_tool0 = robot.from_tcf_to_t0cf(frames)
# ---------- end python_7 ----------
start_configuration = Data(python_6.picking_configuration)
compute = Button()
plan_cartesian_motion = PythonScript(
    robot=robot,
    group=main_planning_group,
    start_configuration=start_configuration,
    frames=python_7,
    max_step=number_slider_3,
    compute=compute)  # -> out, trajectory; inputs frames: list, acm: list
# ---------- plan_cartesian_motion: Python ----------
import logging
import scriptcontext as sc

from compas.geometry import Frame

from compas_ghpython.utilities import update_component

guid = str(ghenv.Component.InstanceGuid)
response_key = "response_" + guid
if response_key not in sc.sticky:
    sc.sticky[response_key] = None

LOGGER = logging.getLogger('roslibpy')
data = dict(requesting_solution=False)

if robot and robot.client and robot.client.is_connected and start_configuration and compute :
    sc.sticky[response_key] = robot.plan_cartesian_motion(frames,
                                                          start_configuration=start_configuration,
                                                          group=group,
                                                          options=dict(
                                                              max_step=float(max_step),
                                                              attached_collision_meshes=list(acm)
                                                          ))

trajectory = sc.sticky[response_key]
# ---------- end plan_cartesian_motion ----------
py_4 = PythonScript(response=plan_cartesian_motion.trajectory)  # -> start_configuration, configurations, fraction, time
# ---------- py_4: Python ----------
from compas_fab.backends.ros import MoveItErrorCodes

joint_positions = []

if response:
    #if response.error_code == MoveItErrorCodes.SUCCESS:
    configurations = response.points
    start_configuration = response.start_configuration
    fraction = response.fraction
    time = response.time_from_start
    print configurations[-1]
# ---------- end py_4 ----------
fraction = Panel(py_4.fraction)
panel_11 = Panel(plan_cartesian_motion.out)
time_s = Panel(py_4.time)
vis = PythonScript(response=plan_cartesian_motion.trajectory)  # -> P, V, A
# ---------- vis: Python ----------
from compas_ghpython import list_to_ghtree

if response:

    positions = []
    velocities = []
    accelerations = []

    for p in response.points:
        positions.append(p.positions)
        velocities.append(p.velocities)
        accelerations.append(p.accelerations)

    P = list_to_ghtree(list(zip(*positions)))
    V = list_to_ghtree(list(zip(*velocities)))
    A = list_to_ghtree(list(zip(*accelerations)))
# ---------- end vis ----------
prismatic = QuickGraph(vis.P, SortOrder=0)
panel_12 = Panel("positions")
graph = QuickGraph(vis.A, SortOrder=0)
graph_2 = QuickGraph(vis.V, SortOrder=0)
panel_13 = Panel("velocities")
panel_14 = Panel("accelerations")

# ---- group: inverse kinematics
pt_2 = Point(Point(0.06049340777, -0.5777847621, 0.003817526587))
xy = XYPlane(Origin=pt_2)
picking_plane = Data(python_6.picking_plane)
list_3 = ValueList({"0", "1"}, selected="1")
filter = StreamFilter(Gate=list_3, Stream0=xy, Stream1=picking_plane)
python_8 = PythonScript(robot=robot, plane=filter)  # -> frame
# ---------- python_8: Python ----------
from compas.geometry import Frame

if robot:
    frame = Frame(plane.Origin, plane.XAxis, plane.YAxis)
    frame = robot.from_tcf_to_t0cf([frame])[0]
# ---------- end python_8 ----------
ik = PythonScript(robot=robot, group=main_planning_group, start_configuration=python_6.picking_configuration, frame=python_8)  # -> out, configuration
# ---------- ik: Python ----------
from compas.geometry import Frame
from compas_fab.backends.ros import RosError
from compas_fab.robots import Configuration

if robot and robot.client and robot.client.is_connected:
    configuration = robot.inverse_kinematics(frame, start_configuration, group)
    print configuration
# ---------- end ik ----------
panel_15 = Panel(ik.out)

# ---- group: cartesian motion
# 4. Append brick to planning scene
panel_16 = Panel("brick_wall")
remove_5 = Button()
append = Button()
collision_4 = PythonScript(scene=scene, brick=element, id=panel_16, append=append, remove=remove_5)  # -> out
# ---------- collision_4: Python ----------
from compas_fab.robots import CollisionMesh

if scene:
    if append:
        cm = CollisionMesh(brick.mesh, id)
        scene.append_collision_mesh(cm)
    if remove:
        scene.remove_collision_mesh(id)
# ---------- end collision_4 ----------
panel_17 = Panel(collision_4)

# ----
py_5 = PythonScript(configurations=py_4.configurations)  # -> last_configuration; inputs configurations: list
# ---------- py_5: Python ----------
from compas_fab.robots import Configuration

if list(configurations) != [None]:
    last_configuration = Configuration(configurations[-1].values, configurations[-1].types)
    print last_configuration
# ---------- end py_5 ----------

# ---- group: plan motion
# 2. 'Move' free-space motion
number_slider_4 = Slider(1, range=1..360)
python_9 = PythonScript(
    robot=robot,
    group=main_planning_group,
    savelevel_target_frame=python_6.safelevel_target_frame,
    tolerance_position=Slider(0.001, range=0..0.001),
    tolerance_xaxis_deg=Slider(1, range=1..360),
    tolerance_yaxis_deg=Slider(1, range=1..360),
    tolerance_zaxis_deg=number_slider_4)  # -> goal_constraints
# ---------- python_9: Python ----------
import math
from compas.geometry import Frame

if robot:
    target_frame_tool0 = robot.from_tcf_to_t0cf([savelevel_target_frame])[0]
    tolerances_axes = [math.radians(tolerance_xaxis_deg), math.radians(tolerance_yaxis_deg), math.radians(tolerance_zaxis_deg)]
    goal_constraints = robot.constraints_from_frame(target_frame_tool0, tolerance_position, tolerances_axes, group)
# ---------- end python_9 ----------
compute_2 = Button()
plan_motion = PythonScript(
    robot=robot,
    group=main_planning_group,
    start_configuration=py_5,
    goal_constraints=python_9,
    planner_id=list_2,
    compute=compute_2)  # -> out, trajectory; inputs goal_constraints: list, path_constraints: list, acm: list
# ---------- plan_motion: Python ----------
import logging
from scriptcontext import sticky as st
import math
from compas.geometry import Frame
from compas_fab.backends import BackendError

from compas_fab.robots import Configuration

from compas_ghpython.utilities import update_component

guid = str(ghenv.Component.InstanceGuid)
response_key = "response_" + guid
if response_key not in st:
    st[response_key] = None

LOGGER = logging.getLogger('roslibpy')
data = dict(requesting_solution=False)

path_constraints = list(path_constraints)
if not len(path_constraints):
    path_constraints = None
    

if robot and robot.client and robot.client.is_connected and start_configuration and compute:
    try:
        st[response_key] = robot.plan_motion(goal_constraints,
                                             start_configuration,
                                             group,
                                             options=dict(
                                                planner_id=str(planner_id),
                                                path_constraints=path_constraints,
                                                attached_collision_meshes=list(acm)
                                             ))
    except BackendError:
        st[response_key] = None

trajectory = st[response_key]
# ---------- end plan_motion ----------
vis_2 = PythonScript(response=plan_motion.trajectory)  # -> P, V, A, time
# ---------- vis_2: Python ----------
from compas_ghpython import list_to_ghtree

if response:

    positions = []
    velocities = []
    accelerations = []
    time_from_start = []

    for p in response.points:
        positions.append(p.positions)
        velocities.append(p.velocities)
        accelerations.append(p.accelerations)
        time_from_start.append(p.time_from_start.seconds)

    P = list_to_ghtree(list(zip(*positions)))
    V = list_to_ghtree(list(zip(*velocities)))
    A = list_to_ghtree(list(zip(*accelerations)))

    time = time_from_start[-1]
    print time
# ---------- end vis_2 ----------
time_s_2 = Panel(vis_2.time)
prismatic_2 = QuickGraph(vis_2.P, SortOrder=0)
panel_18 = Panel(plan_motion.out)
py_6 = PythonScript(response=plan_motion.trajectory)  # -> start_configuration, configurations
# ---------- py_6: Python ----------
from compas_fab.backends.ros import MoveItErrorCodes
from compas_fab.robots import Configuration
joint_positions = []

if response:
    #if response.error_code == MoveItErrorCodes.SUCCESS:
    print response.start_configuration
    print response.planning_time

    configurations = response.points
    start_configuration = response.start_configuration
    #error = response.error_code.human_readable




print start_configuration
# ---------- end py_6 ----------
graph_3 = QuickGraph(vis_2.V, SortOrder=0)
graph_4 = QuickGraph(vis_2.A, SortOrder=0)

# ---- group: cartesian motion
# 3. 'Place' cartesian motion
py_7 = PythonScript(configurations=py_6.configurations)  # -> last_configuration; inputs configurations: list
# ---------- py_7: Python ----------
from compas_fab.robots import Configuration
if list(configurations) != [None]:
    last_configuration = Configuration(configurations[-1].values, configurations[-1].types)
    print last_configuration
# ---------- end py_7 ----------
python_10 = PythonScript(robot=robot, frames=[python_6.safelevel_target_frame, python_6.target_frame])  # -> frames_tool0; inputs frames: list; same code as python_7
compute_3 = Button()
plan_cartesian_motion_2 = PythonScript(
    robot=robot,
    group=main_planning_group,
    start_configuration=py_7,
    frames=python_10,
    max_step=Slider(0.01, range=0..0.01),
    compute=compute_3)  # -> out, response; inputs frames: list, acm: list
# ---------- plan_cartesian_motion_2: Python ----------
import logging
import scriptcontext as sc

from compas.geometry import Frame

guid = str(ghenv.Component.InstanceGuid)
response_key = "response_" + guid
if response_key not in sc.sticky:
    sc.sticky[response_key] = None

LOGGER = logging.getLogger('roslibpy')

if robot and robot.client and robot.client.is_connected and start_configuration and compute:
    sc.sticky[response_key] = robot.plan_cartesian_motion(frames, start_configuration=start_configuration,
                                 group=group,
                                 options=dict(
                                    max_step=float(max_step),
                                    attached_collision_meshes=list(acm)
                                 ))

response = sc.sticky[response_key]
# ---------- end plan_cartesian_motion_2 ----------
py_8 = PythonScript(response=plan_cartesian_motion_2.response)  # -> start_configuration, configurations, fraction, time
# ---------- py_8: Python ----------
from compas_fab.backends.ros import MoveItErrorCodes

joint_positions = []

if response:
    #if response.error_code == MoveItErrorCodes.SUCCESS:
    configurations = response.points
    start_configuration = response.start_configuration
    fraction = response.fraction
    time = response.time_from_start
# ---------- end py_8 ----------
fraction_2 = Panel(py_8.fraction)
panel_22 = Panel(plan_cartesian_motion_2.out)
time_s_3 = Panel(py_8.time)
vis_3 = PythonScript(response=plan_cartesian_motion_2.response)  # -> P, V, A; same code as vis
prismatic_3 = QuickGraph(vis_3.P, SortOrder=0)
graph_5 = QuickGraph(vis_3.A, SortOrder=0)
graph_6 = QuickGraph(vis_3.V, SortOrder=0)

# 5. Add trajectories to element and set to 'planned'
python_11 = PythonScript(
    assembly=generate_assembly.assembly,
    key=number_slider,
    trajectory1=plan_cartesian_motion.trajectory,
    trajectory2=plan_motion.trajectory,
    trajectory3=plan_cartesian_motion_2.response)  # -> out; inputs key: Int32
# ---------- python_11: Python ----------
if trajectory1 and trajectory2 and trajectory3:
    element = assembly.element(key)
    element.trajectory = trajectory1.points + trajectory2.points + trajectory3.points
    assembly.network.node_attribute(key, 'is_planned', True)
# ---------- end python_11 ----------

# ---- group: forward kinematics
fk = PythonScript(group=main_planning_group, configuration=ik.configuration)  # -> out, frame_WCF
# ---------- fk: Python ----------
from compas_fab.robots import Configuration

if robot and robot.client and robot.client.is_connected and configuration:
    configuration = robot.get_group_configuration(group, configuration)
    frame_RCF = robot.forward_kinematics(configuration, group, backend='model')
    frame_WCF = robot.to_world_coordinates(frame_RCF, group)
    print frame_WCF
# ---------- end fk ----------
panel_26 = Panel(fk.out)

# ----
python_12 = PythonScript(trajectory1=py_4.configurations, trajectory2=py_6.configurations, trajectory3=py_8.configurations)  # -> trajectory; inputs trajectory1: list, trajectory2: list, trajectory3: list
# ---------- python_12: Python ----------
trajectory = []

if trajectory1 != [None]:
    trajectory += trajectory1

if trajectory2 != [None]:
    trajectory += trajectory2

if trajectory3 != [None]:
    trajectory += trajectory3
# ---------- end python_12 ----------
counter_3 = CountThroughList(L=python_12, start=start_2, stop=False, step=False, reset=reset_2, interval=1)  # -> item; inputs L: list, start: Boolean, stop: Boolean
# ---------- counter_3: Python ----------
from scriptcontext import sticky as st
from compas_ghpython.utilities import update_component

if not interval:
    interval = 5

# store data in component
guid = str(ghenv.Component.InstanceGuid)
counter_key = "counter_" + guid
running_key = "running_" + guid

if counter_key not in st:
    st[counter_key] = 0

if running_key not in st:
    st[running_key] = False

if start:
    st[running_key] = True

if stop:
    st[running_key] = False

if step:
    if st[counter_key] < len(L) - 1:
        st[counter_key] += 1

if back:
    if st[counter_key] > 1:
        st[counter_key] -= 1

if len(L):
    item = L[st[counter_key]]

if st[running_key]:
    if st[counter_key] < len(L) - 1:
        st[counter_key] += 1
        update_component(ghenv, interval)
    else:
        st[counter_key] = 0
        st[running_key] = False
# ---------- end counter_3 ----------

# ----
# Visualisation
# Select configuration input: from fk, ik, path, or from real robot
list_4 = ValueList({"0 forward_kinematics": 0, "1 inverse_kinematics": 1, "2 'pick_and_place'": 2, "3 from assembly": 3}, selected="3 from assembly")
filter_2 = StreamFilter(Gate=list_4, Stream0=forward_kinematics, Stream1=ik.configuration, Stream2=counter_3, Stream3=counter_2)
show_end_effector_frame = BooleanToggle(True)
show_base_frame = BooleanToggle(False)
show_collision = BooleanToggle(False)
show_frames = BooleanToggle(False)
show_visual = BooleanToggle(True)
show_acm = BooleanToggle(True)
visualize = PythonScript(
    robot=robot,
    group=main_planning_group,
    configuration=filter_2,
    attached_collision_meshes=python_6.element_acm,
    show_visual=show_visual,
    show_collision=show_collision,
    show_end_effector_frame=show_end_effector_frame,
    show_frames=show_frames,
    show_base_frame=show_base_frame,
    show_acm=show_acm)  # -> out, robot, visual, collision, attached_meshes, frames, ee_plane, ee_frame, base_plane, base_frame; inputs attached_collision_meshes: list
# ---------- visualize: Python ----------
from compas.geometry import Vector
from compas.geometry import Point
from compas.geometry import Transformation
from compas.geometry import Frame
from compas_ghpython.artists import MeshArtist
from compas_fab.robots import Configuration

if robot and configuration:
    
    robot.update(configuration, visual=show_visual, collision=show_collision)

    if show_visual:
        visual = robot.artist.draw_visual()

    if show_collision:
        collision = robot.artist.draw_collision()
    
    frames = robot.transformed_frames(configuration, group)

    if show_base_frame:
        base_frame = frames[0]

    if show_end_effector_frame:
        ee_frame = robot.forward_kinematics(configuration, group)
        print("End-effector", ee_frame)
    
    if not show_frames:
        frames = None

    frame = robot.forward_kinematics(configuration, options=dict(solver='model', link_name=robot.attached_tool.link_name))
    robot.artist.update_tool(visual=visual, collision=collision, transformation=Transformation.from_frame_to_frame(Frame.worldXY(), frame))
    
    if show_acm:
        M = []
        for acm in attached_collision_meshes:
            frame = robot.forward_kinematics(configuration, options=dict(solver='model', link_name=acm.link_name))
            T = Transformation.from_frame_to_frame(Frame.worldXY(), frame)
            mesh = acm.collision_mesh.mesh.transformed(T)
            M.append(MeshArtist(mesh).draw())
        attached_meshes = M
# ---------- end visualize ----------
geo_2 = Geometry(visualize.visual)
geo_3 = Geometry(visualize.collision)
preview_6 = CustomPreview(Geometry=geo_2, Shader=ColourSwatch(SwatchColor=RGB(105, 105, 105)))

draw_6 = GhPythonScript(frames=[visualize.frames, visualize.ee_frame, visualize.base_frame], scale=Slider(0.1, range=0..1))  # -> P, V, C, W; inputs frames: list; same code as draw_2
preview_7 = CustomPreview(Geometry=visualize.attached_meshes, Shader=ColourSwatch(SwatchColor=RGB(255, 255, 255)))
vdisex_4 = VectorDisplayEx(Point=draw_6.P, Vector=draw_6.V, Colour=draw_6.C, Width=draw_6.W)
