# Grasshopper definition 052_subscribe_joint_states_visualization.ghx (Grasshopper 1.0.7)

# ----
# Pick up location
pln = Plane(Plane(origin=(0.0625, -0.5825, -0.004999999993), x=(-1, 0, 0), y=(0, -1, 0)))

py = GhPythonScript()  # -> workshop_path, DATA
# ---------- py: Python ----------
import os
import sys

filepath = ghenv.Component.Attributes.Owner.OnPingDocument().FilePath
workshop_path = os.path.abspath(os.path.join(filepath, "..", ".."))
print(workshop_path)

DATA = os.path.abspath(os.path.join(workshop_path, "data"))

# add assembly to sys
sys.path.append(os.path.join(workshop_path, "examples"))
# ---------- end py ----------

# ---- group: ROS client
disconnect = Button()
connect = Button()
connect_2 = PythonScript(ip="127.0.0.1", port="9090", connect=connect, disconnect=disconnect)  # -> out, ros_client; inputs port: Int32
# ---------- connect_2: Python ----------
import sys
import scriptcontext as sc
from compas_fab.backends import RosClient

key = 'rosclient_%s' % str(ghenv.Component.InstanceGuid)
previous_client = sc.sticky.get(key, None)

if previous_client and (connect or disconnect):
    previous_client.close()

if connect:
    ros_client = RosClient(ip, port)
    sc.sticky[key] = ros_client
    ros_client.run(5)

ros_client = sc.sticky.get(key, None)
print('ROS connected: {}'.format(ros_client.is_connected if ros_client else 'False'))
# ---------- end connect_2 ----------
is_connected = Panel(connect_2.out)

# ----
# Robot
# Load robot from ROS
units = ValueList({"m": 1, "cm": 100, "mm": 1000}, selected="m")
load = Button()
create = PythonScript(ros_client=connect_2.ros_client, scale_factor=units, load=load)  # -> robot
# ---------- create: Python ----------
import os
from scriptcontext import sticky as st
import compas
from compas.robots import RobotModel
from compas_fab.backends import RosClient
from compas_fab.backends import RosFileServerLoader
from compas_fab.robots import Robot
from compas_fab.robots import RobotSemantics
from compas_ghpython.artists import RobotModelArtist

# Set high precision to import meshes defined in meters
compas.PRECISION = '24f'

# store robot in component
guid = str(ghenv.Component.InstanceGuid)
robot_key = "robot_" + guid

if robot_key not in st:
    st[robot_key] = None

if ros_client and ros_client.is_connected and load:
    # Load URDF from ROS
    loader = RosFileServerLoader(ros_client)
    urdf = loader.load_urdf()
    srdf = loader.load_srdf()

    # Create robot model from URDF and load geometry
    model = RobotModel.from_urdf_string(urdf)
    model.load_geometry(loader)

    semantics = RobotSemantics.from_srdf_string(srdf, model)

    robot = Robot(model, semantics=semantics)
    robot.artist = RobotModelArtist(robot.model)
    robot.scale(scale_factor)
    st[robot_key] = robot

robot = st[robot_key]
if robot:
    robot.client = ros_client
# ---------- end create ----------
robot = Data(create)

# ----
# Setup Geometry
robot_table = Brep([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])
assembly_table = Brep(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)

panel = Panel(py.workshop_path)
panel_2 = Panel(py.DATA)

# ----
# Config from robot
subscribe = GhPythonScript(ros_client=connect_2.ros_client)
# ---------- subscribe: Python ----------
import scriptcontext as sc

import time
import roslibpy

if ros_client and ros_client.is_connected:
    topic_key = 'ur_joint_states_{}'.format(ghenv.Component.InstanceGuid)
    topic_instance = sc.sticky.get(topic_key, None)

    if topic_instance and topic_instance.is_subscribed:
        print('Unsubscribing old topic...')
        topic_instance.unsubscribe()
        time.sleep(0.2)

    def topic_callback(msg):
        sc.sticky['ur_joint_states'] = msg

    topic_instance = roslibpy.Topic(ros_client, '/ur_joint_states', 'sensor_msgs/JointState')
    topic_instance.subscribe(topic_callback)
    print('Subscribed to topic.')

    sc.sticky[topic_key] = topic_instance
# ---------- end subscribe ----------
timer = Timer(TimerInterval=1000, Target=current)  # disabled
current = GhPythonScript()  # -> config
# ---------- current: Python ----------
from compas.robots import Joint
from compas_fab.robots import Configuration
import scriptcontext as sc

joint_states = sc.sticky.get('ur_joint_states')
if joint_states:
    types = [Joint.REVOLUTE] * len(joint_states['name'])
    config = Configuration(values=joint_states['position'], types=types, joint_names=joint_states['name'])
else:
    config = Configuration([0.0] * 6, [Joint.REVOLUTE] * 6)

print(config)
# ---------- end current ----------

path = Data(panel)
data_path = Data(panel_2)

# ----
# Tool
panel_3 = Panel("vacuum_gripper.json")
show = BooleanToggle(True)
panel_4 = Panel("Set a custom tool")
python = PythonScript(data_path=data_path, filename="airpick.json", show=show)  # -> tool, frame
# ---------- python: Python ----------
import os
from compas.geometry import Frame
from compas.datastructures import Mesh
from compas_ghpython.artists import MeshArtist
from compas_fab.robots import Tool

fullfilename = os.path.join(data_path, filename)
tool = Tool.from_json(fullfilename)
frame = tool.frame
# ---------- end python ----------
attach = BooleanToggle(True)
py_2 = PythonScript(robot=robot, tool=python.tool, attach=attach)
# ---------- py_2: Python ----------
if robot:
    if attach:
        robot.attach_tool(tool)
    else:
        robot.detach_tool()
# ---------- end py_2 ----------
draw = GhPythonScript(frames=python.frame, scale=Slider(0.05, range=0..1))  # -> P, V, C, W; inputs frames: list
# ---------- draw: Python ----------
from System.Drawing import Color
from compas_ghpython.utilities import draw_frame

red = Color.FromArgb(255, 0, 0)
green = Color.FromArgb(0, 255, 0)
blue = Color.FromArgb(0, 0, 255)

P = []
V = []
C = []

scale = float(scale)

for frame in frames:
    if not frame:
        continue
    plane = draw_frame(frame)
    P += [plane.Origin] * 3
    V.append(plane.XAxis * scale)
    V.append(plane.YAxis * scale)
    V.append(plane.ZAxis * scale)
    C += [red, green, blue]

W = 3
# ---------- end draw ----------
vdisex = VectorDisplayEx(Point=draw.P, Vector=draw.V, Colour=draw.C, Width=draw.W)

# ----
# Visualisation
show_end_effector_frame = BooleanToggle(True)
show_base_frame = BooleanToggle(False)
show_collision = BooleanToggle(False)
show_frames = BooleanToggle(False)
show_visual = BooleanToggle(True)
show_acm = BooleanToggle(True)
visualize = PythonScript(
    robot=robot,
    configuration=current,
    show_visual=show_visual,
    show_collision=show_collision,
    show_end_effector_frame=show_end_effector_frame,
    show_frames=show_frames,
    show_base_frame=show_base_frame,
    show_acm=show_acm)  # -> out, robot, visual, collision, attached_meshes, frames, ee_plane, ee_frame, base_plane, base_frame; inputs attached_collision_meshes: list
# ---------- visualize: Python ----------
from compas.geometry import Vector
from compas.geometry import Point
from compas.geometry import Transformation
from compas.geometry import Frame
from compas_ghpython.artists import MeshArtist
from compas_fab.robots import Configuration

if robot and configuration:
    
    robot.update(configuration, visual=show_visual, collision=show_collision)

    if show_visual:
        visual = robot.artist.draw_visual()

    if show_collision:
        collision = robot.artist.draw_collision()
    
    frames = robot.transformed_frames(configuration, group)

    if show_base_frame:
        base_frame = frames[0]

    if show_end_effector_frame:
        ee_frame = robot.forward_kinematics(configuration, group)
        print("End-effector", ee_frame)
    
    if not show_frames:
        frames = None

    frame = robot.forward_kinematics(configuration, options=dict(solver='model', link_name=robot.attached_tool.link_name))
    robot.artist.update_tool(visual=visual, collision=collision, transformation=Transformation.from_frame_to_frame(Frame.worldXY(), frame))
    
    if show_acm:
        M = []
        for acm in attached_collision_meshes:
            frame = robot.forward_kinematics(configuration, options=dict(solver='model', link_name=acm.link_name))
            T = Transformation.from_frame_to_frame(Frame.worldXY(), frame)
            mesh = acm.collision_mesh.mesh.transformed(T)
            M.append(MeshArtist(mesh).draw())
        attached_meshes = M
# ---------- end visualize ----------
geo = Geometry(visualize.visual)
geo_2 = Geometry(visualize.collision)
preview = CustomPreview(Geometry=geo, Shader=ColourSwatch(SwatchColor=RGB(105, 105, 105)))

draw_2 = GhPythonScript(frames=[visualize.frames, visualize.ee_frame, visualize.base_frame], scale=Slider(0.1, range=0..1))  # -> P, V, C, W; inputs frames: list; same code as draw
preview_2 = CustomPreview(Geometry=visualize.attached_meshes, Shader=ColourSwatch(SwatchColor=RGB(255, 255, 255)))
vdisex_2 = VectorDisplayEx(Point=draw_2.P, Vector=draw_2.V, Colour=draw_2.C, Width=draw_2.W)
