# Grasshopper definition 100_um_setup.ghx (Grasshopper 1.0.7)

reload = Button()
py = GhPythonScript()  # -> workshop_path
# ---------- py: Python ----------
import os

filepath = ghenv.Component.Attributes.Owner.OnPingDocument().FilePath
workshop_path = os.path.abspath(os.path.join(filepath, "..", ".."))
print(workshop_path)
# ---------- end py ----------

# ---- group: ROS client
# Robot
disconnect = Button()
connect = Button()
restart = Button()
ros = PythonScript(ip="127.0.0.1", restart=restart)  # -> out, ros_client
# ---------- ros: Python ----------
import sys
import time
import logging
import scriptcontext as sc

from compas_fab.backends import RosClient

from System import TimeSpan
from System.Threading import ManualResetEventSlim

LOGGER = logging.getLogger('roslibpy')

key = 'rosclient_%s' % str(ghenv.Component.InstanceGuid)
previous_client = sc.sticky.get(key, None)
if previous_client:
    previous_client.terminate()

ros_client = RosClient(ip, 9090)
sc.sticky[key] = ros_client

waitLock = ManualResetEventSlim(False)

ros_client.on_ready(lambda: waitLock.Set())

if not waitLock.Wait(TimeSpan.FromSeconds(5)):
    raise Exception('Unable to connect to ROS')

LOGGER.info('ROS connection opened')
# ---------- end ros ----------
connect_2 = PythonScript(ros_client=ros.ros_client, connect=connect, disconnect=disconnect)  # -> is_connected, ros_client
# ---------- connect_2: Python ----------
import logging
from System import TimeSpan
from System.Threading import ManualResetEventSlim

LOGGER = logging.getLogger('roslibpy')

if connect:
    if not ros_client.is_connected:
        LOGGER.debug('Connecting...')
        waitLock = ManualResetEventSlim(False)
        ros_client.on_ready(lambda: waitLock.Set())
        ros_client.connect()

        if not waitLock.Wait(TimeSpan.FromSeconds(5)):
            raise Exception('Unable to connect to ROS')
        LOGGER.debug('Reconnected')

if disconnect:
    if ros_client.is_connected:
        ros_client.terminate()
        LOGGER.debug('Terminated')

is_connected = ros_client.is_connected
# ---------- end connect_2 ----------
panel = Panel(connect_2.is_connected)

# ----
# Load UM setup from ROS
load = Button()
create = PythonScript(ros_client=connect_2.ros_client, load=load)  # -> robot
# ---------- create: Python ----------
import os
from scriptcontext import sticky as st

import compas
from compas_fab.robots.ur5 import Robot
from compas_fab.ghpython import RobotArtist

compas.PRECISION = '12f'

# store robot in component
guid = str(ghenv.Component.InstanceGuid)
robot_key = "robot_" + guid

if robot_key not in st:
    st[robot_key] = None

if load and ros_client.is_connected:
    robot = ros_client.load_robot(load_geometry=True)
    robot.artist = RobotArtist(robot.model)
    st[robot_key] = robot

if ros_client:
    st[robot_key].client = ros_client

robot = st[robot_key]
# ---------- end create ----------
robot = Data(create)

# ----
# Planning scene
# Pass collision objects to planning scene
scene = PythonScript(robot=robot)  # -> scene
# ---------- scene: Python ----------
from scriptcontext import sticky as st

from compas_fab.robots import PlanningScene

# store scene in component
guid = str(ghenv.Component.InstanceGuid)
scene_key = "scene_" + guid

if scene_key not in st:
    st[scene_key] = None

if robot:
    st[scene_key] = PlanningScene(robot)

scene = st[scene_key]
# ---------- end scene ----------

py_2 = PythonScript(reload=reload)
# ---------- py_2: Python ----------
from compas_rhino.utilities.misc import get_tolerance
from compas_rhino.utilities.misc import unload_modules

from compas_ghpython import unload_modules
unload_modules("compas")
unload_modules("compas_fab")
unload_modules("roslibpy")
# ---------- end py_2 ----------
panel_2 = Panel(py)
path = Data(panel_2)

# ----
# Attach an collision object to a link
panel_3 = Panel("bag.stl")
mesh = PythonScript(workshop_path=path, file=panel_3)  # -> compas_mesh, M
# ---------- mesh: Python ----------
import os
from compas.datastructures import Mesh
from compas_ghpython.artists import MeshArtist

stlfile = os.path.join(workshop_path, "kuka_kr60","um_kr60_setup", "meshes", "collision", file)
compas_mesh = Mesh.from_stl(stlfile)

M = MeshArtist(compas_mesh).draw_mesh()
# ---------- end mesh ----------
preview = CustomPreview(Geometry=mesh.M, Material=ColourSwatch(SwatchColor=RGB(171, 171, 171)))
remove = Button()
remove_2 = Button()
scale = BooleanToggle(False)
scale_2 = BooleanToggle(False)
add = Button()
add_2 = Button()
attached = PythonScript(scene=scene, compas_mesh=mesh.compas_mesh, scale=scale, id="bag_right", link_name="right_link_3", add=add, remove=remove)  # -> acm; inputs touch_links: list
# ---------- attached: Python ----------
from compas_fab.robots import CollisionMesh
from compas_fab.robots import AttachedCollisionMesh

cm = CollisionMesh(compas_mesh, id)
acm = AttachedCollisionMesh(cm, link_name, touch_links)

if scene:
    if add:
        scene.add_attached_collision_mesh(acm, scale)
    if remove:
        scene.remove_attached_collision_mesh(id)
        scene.remove_collision_mesh(id)
# ---------- end attached ----------
attached_2 = PythonScript(
    scene=scene,
    compas_mesh=mesh.compas_mesh,
    scale=scale_2,
    id="bag_left",
    link_name="left_link_3",
    add=add_2,
    remove=remove_2)  # -> acm; inputs touch_links: list; same code as attached
acms = Data([attached, attached_2])

# ----
# Load scene collision objects
panel_4 = Panel("collision_objects_scene.stl")
mesh_2 = PythonScript(workshop_path=path, file=panel_4)  # -> compas_mesh, M; same code as mesh
preview_2 = CustomPreview(Geometry=mesh_2.M, Material=ColourSwatch(SwatchColor=RGB(110, 196, 204)))
remove_3 = Button()
scale_3 = BooleanToggle(False)
add_3 = Button()
collision = PythonScript(scene=scene, compas_mesh=mesh_2.compas_mesh, scale=scale_3, id="scene_obj", add=add_3, remove=remove_3)  # -> out
# ---------- collision: Python ----------
from compas_fab.robots import CollisionMesh

cm = CollisionMesh(compas_mesh, id)

if scene:
    if add:
        scene.add_collision_mesh(cm, scale)
    if remove:
        scene.remove_collision_mesh(id)
# ---------- end collision ----------
panel_5 = Panel(collision)

# ----
# Attach tool
panel_6 = Panel("tool.stl")
mesh_3 = PythonScript(workshop_path=path, file=panel_6)  # -> compas_mesh, M; same code as mesh
preview_3 = CustomPreview(Geometry=mesh_3.M, Material=ColourSwatch(SwatchColor=RGB(171, 171, 171)))
attach = BooleanToggle(False)
list = ValueList({"robotL", "robotR"}, selected="robotR")
xy = XYPlane(Origin=Point(0, 0, 0))
tool = PythonScript(robot=robot, compas_mesh=mesh_3.compas_mesh, plane=xy, attach=attach, group=list)  # -> compas_mesh
# ---------- tool: Python ----------
from compas.geometry import Frame
from compas_fab.robots import Tool

frame = Frame(plane.Origin, plane.XAxis, plane.YAxis)
tool = Tool(compas_mesh, frame)

if robot and attach:
    robot.attach_tool(tool, group=group)
else:
    robot.detach_tool()
# ---------- end tool ----------

# ----
# Info
info = PythonScript(robot=robot)  # -> out, main_group_name
# ---------- info: Python ----------
if robot:
    robot.info()
    main_group_name = robot.main_group_name
# ---------- end info ----------
panel_7 = Panel(info.out)

# ----
# Configuration
# robotR
list_2 = ValueList({"robotL", "robotR"}, selected="robotR")

# ---- group: forward kinematics
a1 = Slider(22, range=-360..360)
a5 = Slider(35, range=-360..360)
a6 = Slider(10, range=-360..360)
a2 = Slider(-54, range=-360..360)
a4 = Slider(-1, range=-360..360)
a3 = Slider(106, range=-360..360)
set_joint_positions = BooleanToggle(False)
jp = GhPythonScript()  # -> joint_positions
# ---------- jp: Python ----------
import math
joint_positions = [-3.136, -0.328, -1.218, 3.129, 0.852, 0.008]
joint_positions = [0] * 6
joint_positions = [0.384, -0.942, 1.850, -0.017, 0.611, 0.175]
print joint_positions
# ---------- end jp ----------
forward_kinematics = PythonScript(
    robot=robot,
    group=list_2,
    set_joint_positions=set_joint_positions,
    joint_positions=jp,
    a1=a1,
    a2=a2,
    a3=a3,
    a4=a4,
    a5=a5,
    a6=a6)  # -> configuration; inputs joint_positions: list
# ---------- forward_kinematics: Python ----------
import math
import Grasshopper
from compas_fab.robots import Configuration

if set_joint_positions:

    j = 0
    for i in range(ghenv.Component.Params.Input.Count):
        nslider = ghenv.Component.Params.Input[i].Sources[0]
        if nslider.GetType() == Grasshopper.Kernel.Special.GH_NumberSlider:
            nslider.TrySetSliderValue(math.degrees(joint_positions[j]))
            j += 1

if robot:
    joint_positions = [a1, a2, a3, a4, a5, a6]
    joint_positions = [math.radians(a) for a in joint_positions]
    types = robot.get_configurable_joint_types(group)
    configuration = Configuration(joint_positions, types)
    print configuration
# ---------- end forward_kinematics ----------

# ----
# robotL
list_3 = ValueList({"robotL", "robotR"}, selected="robotL")

# ---- group: forward kinematics
a6_2 = Slider(10, range=-360..360)
a1_2 = Slider(22, range=-360..360)
a4_2 = Slider(-1, range=-360..360)
a5_2 = Slider(35, range=-360..360)
a2_2 = Slider(-54, range=-360..360)
a3_2 = Slider(106, range=-360..360)
set_joint_positions_2 = BooleanToggle(False)
jp_2 = GhPythonScript()  # -> joint_positions; same code as jp
forward_kinematics_2 = PythonScript(
    robot=robot,
    group=list_3,
    set_joint_positions=set_joint_positions_2,
    joint_positions=jp_2,
    a1=a1_2,
    a2=a2_2,
    a3=a3_2,
    a4=a4_2,
    a5=a5_2,
    a6=a6_2)  # -> configuration; inputs joint_positions: list; same code as forward_kinematics

# ----
py_3 = GhPythonScript(configurationR=forward_kinematics, configurationL=forward_kinematics_2)  # -> start_configuration
# ---------- py_3: Python ----------
from compas_fab.robots import Configuration

L, R = configurationL, configurationR
start_configuration = Configuration(L.values + R.values, L.types + R.types)
# ---------- end py_3 ----------

# ---- group: cartesian motion
# Plan cartesian motion
Z = UnitZ(Factor=-1)
Z_2 = UnitZ(Factor=-1)
pt = Point(Point(1.498612104, -0.1576914179, 1.058441882))
pt_2 = Point(Point(1.052018954, -0.5503627947, 0.754657247))
group = Text(list_2)
py_4 = GhPythonScript(pt=pt, zaxis=Z)  # -> pln
# ---------- py_4: Python ----------
import Rhino.Geometry as rg


pln = rg.Plane(pt, zaxis)
# ---------- end py_4 ----------
py_5 = GhPythonScript(pt=pt_2, zaxis=Z_2)  # -> pln; same code as py_4
py_6 = PythonScript(robot=robot)  # -> configuration
# ---------- py_6: Python ----------
from compas_fab.robots import Configuration

if robot:
    types = robot.get_configurable_joint_types()
    values = [0] * len(types)

    configuration = Configuration(values, types)
    print configuration
# ---------- end py_6 ----------
list_4 = ValueList({"don't use attached collision mesh": 0, "use attached collision mesh": 1}, selected="use attached collision mesh")
start_configuration = Data(py_3)
list_5 = ValueList({"0", "1"}, selected="0")
avoid_collisions = BooleanToggle(True)
py_7 = PythonScript(start_plane=py_5, end_plane=py_4)  # -> planes
# ---------- py_7: Python ----------
planes = [start_plane, end_plane]
print planes
# ---------- end py_7 ----------
compute = Button()
filter = StreamFilter(Gate=list_5, Stream0=start_configuration, Stream1=py_6)
filter_2 = StreamFilter(Gate=list_4, Stream1=acms)
plan_cartesian_motion = PythonScript(
    robot=robot,
    group=group,
    start_configuration=filter,
    planes=py_7,
    max_step=Slider(0.01, range=0..0.01),
    avoid_collisions=avoid_collisions,
    acm=filter_2,
    compute=compute)  # -> out, response; inputs planes: list, avoid_collisions: Boolean, acm: list
# ---------- plan_cartesian_motion: Python ----------
import logging
import scriptcontext as sc

from compas.geometry import Frame

from compas_ghpython.utilities import update_component

guid = str(ghenv.Component.InstanceGuid)
response_key = "response_" + guid
if response_key not in sc.sticky:
    sc.sticky[response_key] = None

LOGGER = logging.getLogger('roslibpy')
data = dict(requesting_solution=False)



if robot:
    if robot.client:
        if robot.client.is_connected:
            if start_configuration and compute:
                frames = [Frame(plane.Origin, plane.XAxis, plane.YAxis) for plane in planes]
                response = robot.plan_cartesian_motion(frames, start_configuration=start_configuration,
                                             max_step=float(max_step),
                                             avoid_collisions=bool(avoid_collisions),
                                             group=group,
                                             attached_collision_meshes=list(acm))
                sc.sticky[response_key] = response
                # update_component(ghenv, 100)  # Not needed now that it is sync?
        else:
            print("Robot is not connected")
            sc.sticky[response_key] = None

response = sc.sticky[response_key]
# ---------- end plan_cartesian_motion ----------
vis = PythonScript(response=plan_cartesian_motion.response)  # -> P, V, A
# ---------- vis: Python ----------
from compas_ghpython import list_to_ghtree

if response:

    positions = []
    velocities = []
    accelerations = []

    for p in response.points:
        positions.append(p.positions)
        velocities.append(p.velocities)
        accelerations.append(p.accelerations)

    P = list_to_ghtree(list(zip(*positions)))
    V = list_to_ghtree(list(zip(*velocities)))
    A = list_to_ghtree(list(zip(*accelerations)))
# ---------- end vis ----------
py_8 = PythonScript(response=plan_cartesian_motion.response)  # -> start_configuration, configurations, fraction, time
# ---------- py_8: Python ----------
from compas_fab.backends.ros import MoveItErrorCodes

joint_positions = []

if response:
    #if response.error_code == MoveItErrorCodes.SUCCESS:
    configurations = response.points
    start_configuration = response.start_configuration
    fraction = response.fraction
    time = response.time_from_start
# ---------- end py_8 ----------
panel_8 = Panel(plan_cartesian_motion.out)
fraction = Panel(py_8.fraction)
time_s = Panel(py_8.time)
prismatic = QuickGraph(vis.P, SortOrder=0)
panel_9 = Panel("positions")
animate = PythonScript(robot=robot, group=group, start_configuration=filter, configurations=py_8.configurations, value=Slider(1, range=0..1))  # -> configuration; inputs configurations: list
# ---------- animate: Python ----------
from compas_fab.utilities import map_range
from compas_fab.robots import Configuration

count = len(configurations)
if count and robot and configurations[0] != None:
    idx = int(map_range(value, 0, 1, 0, count - 1))
    current_configuration = configurations[idx]
    configuration = robot.merge_group_with_full_configuration(current_configuration, start_configuration, group)
# ---------- end animate ----------
graph = QuickGraph(vis.V, SortOrder=0)
graph_2 = QuickGraph(vis.A, SortOrder=0)
panel_10 = Panel("velocities")
panel_11 = Panel("accelerations")

# ---- group: inverse kinematics
pt_3 = Point(Point(1.052018954, -0.5503627947, 0.754657247))
Z_3 = UnitZ(Factor=-1)
py_9 = GhPythonScript(pt=pt_3, zaxis=Z_3)  # -> pln; same code as py_4
ik = PythonScript(robot=robot, group=list_2, start_configuration=py_3, plane=py_9)  # -> out, configuration
# ---------- ik: Python ----------
import scriptcontext as sc
import logging

from compas.geometry import Frame

from compas_fab.backends.ros import RosError
from compas_fab.robots import Configuration

if robot:
    if robot.client:
        if robot.client.is_connected:
            frame = Frame(plane.Origin, plane.XAxis, plane.YAxis)
            configuration = robot.inverse_kinematics(frame, start_configuration, group)
            print(configuration)
        else:
            print("Robot is not connected")
    else:
        print("Robot is not connected")
# ---------- end ik ----------
panel_12 = Panel(ik.out)

# ---- group: plan motion
# Plan motion
# TODO Example:
# Add path constraints
group_2 = Text(list_2)
py_10 = PythonScript(robot=robot)  # -> configuration; same code as py_6
list_6 = ValueList({"don't use attached collision mesh": 0, "use attached collision mesh": 1}, selected="use attached collision mesh")
python = PythonScript(
    robot=robot,
    group=group_2,
    goal_plane=py_4,
    tolerance_position=Slider(0.001, range=0..0.001),
    tolerance_xaxis_deg=Slider(360, range=1..360),
    tolerance_yaxis_deg=Slider(1, range=1..360),
    tolerance_zaxis_deg=Slider(1, range=1..360))  # -> goal_constraints
# ---------- python: Python ----------
import math
from compas.geometry import Frame

frame = Frame(goal_plane.Origin, goal_plane.XAxis, goal_plane.YAxis)

tolerances_axes = [math.radians(tolerance_xaxis_deg), math.radians(tolerance_yaxis_deg), math.radians(tolerance_zaxis_deg)]

if robot:
    goal_constraints = robot.constraints_from_frame(frame, tolerance_position, tolerances_axes, group)
# ---------- end python ----------
start_configuration_2 = Data(py_3)
list_7 = ValueList({"0", "1"}, selected="0")
compute_2 = Button()
filter_3 = StreamFilter(Gate=list_7, Stream0=start_configuration_2, Stream1=py_10)
list_8 = ValueList({"RRT", "RRT*": "RRTStar", "EST", "PRM": "RPM", "PRM*": "RPMStar", "SPARS"}, selected="RRT")
filter_4 = StreamFilter(Gate=list_6, Stream1=acms)
plan_motion = PythonScript(robot=robot, start_configuration=filter_3, goal_constraints=python, planner_id=list_8, acm=filter_4, compute=compute_2)  # -> out, response; inputs goal_constraints: list, path_constraints: list, acm: list
# ---------- plan_motion: Python ----------
import logging
from scriptcontext import sticky as st
import math
from compas.geometry import Frame

from compas_fab.robots import Configuration

from compas_ghpython.utilities import update_component

guid = str(ghenv.Component.InstanceGuid)
response_key = "response_" + guid
if response_key not in st:
    st[response_key] = None

LOGGER = logging.getLogger('roslibpy')
data = dict(requesting_solution=False)

path_constraints = list(path_constraints)
if not len(path_constraints):
    path_constraints = None

if robot and robot.client and robot.client.is_connected and start_configuration and compute:
    st[response_key] = robot.plan_motion(goal_constraints,
                                         start_configuration,
                                         group,
                                         planner_id=str(planner_id),
                                         path_constraints=path_constraints,
                                         attached_collision_meshes=list(acm))

response = st[response_key]
# ---------- end plan_motion ----------
vis_2 = PythonScript(response=plan_motion.response)  # -> P, V, A, time
# ---------- vis_2: Python ----------
from compas_ghpython import list_to_ghtree

if response:

    positions = []
    velocities = []
    accelerations = []
    time_from_start = []

    for p in response.points:
        positions.append(p.positions)
        velocities.append(p.velocities)
        accelerations.append(p.accelerations)
        time_from_start.append(p.time_from_start.seconds)

    P = list_to_ghtree(list(zip(*positions)))
    V = list_to_ghtree(list(zip(*velocities)))
    A = list_to_ghtree(list(zip(*accelerations)))

    time = time_from_start[-1]
    print time
# ---------- end vis_2 ----------
time_s_2 = Panel(vis_2.time)
prismatic_2 = QuickGraph(vis_2.P, SortOrder=0)
py_11 = PythonScript(robot=robot, response=plan_motion.response)  # -> start_configuration, configurations, error
# ---------- py_11: Python ----------
from compas_fab.backends.ros import MoveItErrorCodes
from compas_fab.robots import Configuration
joint_positions = []

if response:
    print response.start_configuration
    print response.planning_time
    configurations = response.points
    start_configuration = response.start_configuration


print start_configuration
# ---------- end py_11 ----------
error = Panel(py_11.error)
panel_13 = Panel(plan_motion.out)
animate_2 = PythonScript(
    robot=robot,
    start_configuration=py_11.start_configuration,
    configurations=py_11.configurations,
    value=Slider(1, range=0..1))  # -> configuration; inputs configurations: list
# ---------- animate_2: Python ----------
from compas_fab.utilities import map_range
from compas_fab.robots import Configuration

count = len(configurations)

if count and robot and configurations[0] != None:
    idx = int(map_range(value, 0, 1, 0, count - 1))
    current_configuration = configurations[idx]
    #make full configuration
    configuration = robot.merge_group_with_full_configuration(current_configuration, start_configuration, group)
# ---------- end animate_2 ----------
graph_3 = QuickGraph(vis_2.V, SortOrder=0)
graph_4 = QuickGraph(vis_2.A, SortOrder=0)

# ---- group: forward kinematics
fk = PythonScript(robot=robot, group=list_2, configuration=ik.configuration)  # -> out, frame_WCF
# ---------- fk: Python ----------
frame_RCF = robot.forward_kinematics(configuration, group, backend='model')
frame_WCF = robot.to_world_coords(frame_RCF, group)

print frame_WCF
# ---------- end fk ----------
panel_17 = Panel(fk.out)

# ---- group: cartesian motion
# Plan cartesian motion
Z_4 = UnitZ(Factor=-1)
Z_5 = UnitZ(Factor=-1)
pt_4 = Point(Point(1.052018954, -2.588949867, 1.058441882))
pt_5 = Point(Point(1.052018954, -2.169228515, 0.754657247))
group_3 = Text(list_3)
py_12 = GhPythonScript(pt=pt_4, zaxis=Z_4)  # -> pln; same code as py_4
py_13 = GhPythonScript(pt=pt_5, zaxis=Z_5)  # -> pln; same code as py_4
py_14 = PythonScript(robot=robot)  # -> configuration; same code as py_6
list_9 = ValueList({"don't use attached collision mesh": 0, "use attached collision mesh": 1}, selected="use attached collision mesh")
start_configuration_3 = Data(py_3)
list_10 = ValueList({"0", "1"}, selected="0")
avoid_collisions_2 = BooleanToggle(True)
py_15 = PythonScript(start_plane=py_13, end_plane=py_12)  # -> planes; same code as py_7
compute_3 = Button()
filter_5 = StreamFilter(Gate=list_10, Stream0=start_configuration_3, Stream1=py_14)
filter_6 = StreamFilter(Gate=list_9, Stream1=acms)
plan_cartesian_motion_2 = PythonScript(
    robot=robot,
    group=group_3,
    start_configuration=filter_5,
    planes=py_15,
    max_step=Slider(0.01, range=0..0.01),
    avoid_collisions=avoid_collisions_2,
    acm=filter_6,
    compute=compute_3)  # -> out, response; inputs planes: list, avoid_collisions: Boolean, acm: list; same code as plan_cartesian_motion
vis_3 = PythonScript(response=plan_cartesian_motion_2.response)  # -> P, V, A; same code as vis
py_16 = PythonScript(response=plan_cartesian_motion_2.response)  # -> start_configuration, configurations, fraction, time; same code as py_8
panel_18 = Panel(plan_cartesian_motion_2.out)
fraction_2 = Panel(py_16.fraction)
time_s_3 = Panel(py_16.time)
prismatic_3 = QuickGraph(vis_3.P, SortOrder=0)
animate_3 = PythonScript(
    robot=robot,
    group=group_3,
    start_configuration=filter_5,
    configurations=py_16.configurations,
    value=Slider(1, range=0..1))  # -> configuration; inputs configurations: list
# ---------- animate_3: Python ----------
from compas_fab.utilities import map_range
from compas_fab.robots import Configuration

count = len(configurations)
if count and robot and configurations[0] != None:
    idx = int(map_range(value, 0, 1, 0, count - 1))
    current_configuration = configurations[idx]
    print current_configuration
    configuration = robot.merge_group_with_full_configuration(current_configuration, start_configuration, group)
# ---------- end animate_3 ----------
graph_5 = QuickGraph(vis_3.V, SortOrder=0)
graph_6 = QuickGraph(vis_3.A, SortOrder=0)

# ---- group: inverse kinematics
Z_6 = UnitZ(Factor=-1)
pt_6 = Point(Point(1.052018954, -2.158806549, 0.8754056843))
py_17 = GhPythonScript(pt=pt_6, zaxis=Z_6)  # -> pln; same code as py_4
ik_2 = PythonScript(robot=robot, group=list_3, start_configuration=py_3, plane=py_17)  # -> out, configuration; same code as ik
panel_22 = Panel(ik_2.out)

# ---- group: plan motion
# Plan motion
# If you specify the tolerance vector with [360, 1, 1], it means that
#     the frame's y-axis and z-axis are allowed to rotate about the x-axis by an
#     angle of 360 degrees, whereas the x-axis can only change 1 degree.
# TODO Example:
# Add path constraints
group_4 = Text(list_3)
py_18 = PythonScript(robot=robot)  # -> configuration; same code as py_6
list_11 = ValueList({"don't use attached collision mesh": 0, "use attached collision mesh": 1}, selected="use attached collision mesh")
python_2 = PythonScript(
    robot=robot,
    group=group_4,
    goal_plane=py_12,
    tolerance_position=Slider(0.001, range=0..0.001),
    tolerance_xaxis_deg=Slider(360, range=1..360),
    tolerance_yaxis_deg=Slider(1, range=1..360),
    tolerance_zaxis_deg=Slider(1, range=1..360))  # -> goal_constraints; same code as python
start_configuration_4 = Data(py_3)
list_12 = ValueList({"0", "1"}, selected="0")
compute_4 = Button()
filter_7 = StreamFilter(Gate=list_12, Stream0=start_configuration_4, Stream1=py_18)
list_13 = ValueList({"RRT", "RRT*": "RRTStar", "EST", "PRM": "RPM", "PRM*": "RPMStar", "SPARS"}, selected="RRT")
filter_8 = StreamFilter(Gate=list_11, Stream1=acms)
plan_motion_2 = PythonScript(
    robot=robot,
    start_configuration=filter_7,
    goal_constraints=python_2,
    planner_id=list_13,
    acm=filter_8,
    compute=compute_4)  # -> out, response; inputs goal_constraints: list, path_constraints: list, acm: list; same code as plan_motion
vis_4 = PythonScript(response=plan_motion_2.response)  # -> P, V, A, time; same code as vis_2
time_s_4 = Panel(vis_4.time)
py_19 = PythonScript(robot=robot, response=plan_motion_2.response)  # -> start_configuration, configurations, error
# ---------- py_19: Python ----------
from compas_fab.backends.ros import MoveItErrorCodes
from compas_fab.robots import Configuration
joint_positions = []

if response:
    #if response.error_code == MoveItErrorCodes.SUCCESS:
    print response.start_configuration
    print response.planning_time

    configurations = response.points
    start_configuration = response.start_configuration
    #error = response.error_code.human_readable




print start_configuration
# ---------- end py_19 ----------
prismatic_4 = QuickGraph(vis_4.P, SortOrder=0)
panel_23 = Panel(plan_motion_2.out)
error_2 = Panel(py_19.error)
animate_4 = PythonScript(
    robot=robot,
    start_configuration=py_19.start_configuration,
    configurations=py_19.configurations,
    value=Slider(1, range=0..1))  # -> configuration; inputs configurations: list
# ---------- animate_4: Python ----------
from compas_fab.utilities import map_range
from compas_fab.robots import Configuration

count = len(configurations)
if count and robot and configurations[0] != None:
    idx = int(map_range(value, 0, 1, 0, count - 1))
    current_configuration = configurations[idx]
    #make full configuration
    configuration = robot.merge_group_with_full_configuration(current_configuration, start_configuration, group)
# ---------- end animate_4 ----------
graph_7 = QuickGraph(vis_4.V, SortOrder=0)
graph_8 = QuickGraph(vis_4.A, SortOrder=0)

# ---- group: forward kinematics
fk_2 = PythonScript(robot=robot, group=list_3, configuration=ik_2.configuration)  # -> out, frame_WCF; same code as fk
panel_27 = Panel(fk_2.out)

# ----
# Visualisation
# Select configuration input: from fk, ik, path, or from real robot
list_14 = ValueList({"0 forward_kinematics": 0, "1 inverse_kinematics": 1, "2 cartesian path": 2, "3 kinetic path": 3}, selected="0 forward_kinematics")
list_15 = ValueList({"0 forward_kinematics": 0, "1 inverse_kinematics": 1, "2 cartesian path": 2, "3 kinetic path": 3}, selected="0 forward_kinematics")
filter_9 = StreamFilter(Gate=list_14, Stream0=forward_kinematics, Stream1=ik.configuration, Stream2=animate, Stream3=animate_2)
filter_10 = StreamFilter(Gate=list_15, Stream0=forward_kinematics_2, Stream1=ik_2.configuration, Stream2=animate_3, Stream3=animate_4)
py_20 = GhPythonScript(configurationR=filter_9, configurationL=filter_10)  # -> full_configuration
# ---------- py_20: Python ----------
from compas_fab.robots import Configuration

L, R = configurationL, configurationR
full_configuration = Configuration(L.values + R.values, L.types + R.types)
# ---------- end py_20 ----------
show_end_effector_frame = BooleanToggle(True)
show_base_frame = BooleanToggle(False)
show_collision = BooleanToggle(False)
show_frames = BooleanToggle(True)
show_visual = BooleanToggle(True)
show_acm = BooleanToggle(True)
visualize = PythonScript(
    robot=robot,
    configuration=py_20,
    show_visual=show_visual,
    show_collision=show_collision,
    show_frames=show_frames,
    show_base_frame=show_base_frame,
    show_end_effector_frame=show_end_effector_frame)  # -> out, visual, collision, frames, frames_color, ee_plane, ee_frame, ee_frame_geo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
# ---------- visualize: Python ----------
from System.Drawing import Color

from compas.geometry import Vector
from compas.geometry import Point
from compas_ghpython.utilities import draw_frame
from compas_ghpython.utilities import draw_pipes

from compas_fab.robots import Configuration

red = Color.FromArgb(255, 0, 0)
green = Color.FromArgb(0, 255, 0)
blue = Color.FromArgb(0, 0, 255)

frame_colors = [red, green, blue]

# TODO: move to frame artist?
def pipes_from_frame(frame, size, radius):
    pipes = []
    for axis in [frame.xaxis, frame.yaxis, frame.zaxis]:
        pipe = {}
        pipe['points'] = [list(frame.point), list(Point(*frame.point) + Vector(*axis) * size)]
        pipe['radius'] = radius
        pipes.append(pipe)
    return pipes

if robot and configuration:
    print configuration
    robot.update(configuration, collision=bool(show_collision))

    print("Configuration:")
    print(configuration.values)

    if show_visual:
        visual = robot.draw_visual()

    if show_collision:
        collision = robot.draw_collision()

    pipe_size = 0.1 * robot.scale_factor
    pipe_radius = 0.001 * robot.scale_factor


    axes = robot.transformed_axes(configuration)

    frames = robot.transformed_frames(configuration)

    if show_frames:

        pipes = []
        frames_color = []
        for frame in frames:
            pipes += pipes_from_frame(frame, pipe_size, pipe_radius)
            frames_color += frame_colors
        frames = draw_pipes(pipes, cap=1)

    ee_frame_RCF = robot.forward_kinematics(configuration, backend='model')
    
    ee_frame = robot.to_world_coords(ee_frame_RCF)
    ee_plane = draw_frame(ee_frame)

    print("End-effector frame:")
    print(ee_frame)

    if show_end_effector_frame:
        ee_pipes = pipes_from_frame(ee_frame, pipe_size, pipe_radius)
        ee_frame_geo = draw_pipes(ee_pipes, cap=1)
        ee_frame_color = frame_colors

    base_frame = robot.get_base_frame()
    base_plane = draw_frame(base_frame)

    if show_base_frame:
        base_pipes = pipes_from_frame(base_frame, pipe_size, pipe_radius)
        base_frame_geo = draw_pipes(base_pipes, cap=1)
        base_frame_color = frame_colors
# ---------- end visualize ----------
visualize_2 = GhPythonScript(acms=acms, robot=robot, configuration=py_20, show=show_acm)  # -> M; inputs acms: list
# ---------- visualize_2: Python ----------
from compas_ghpython.artists import MeshArtist
from compas.datastructures import mesh_transformed
from compas.geometry import Transformation, Frame

M = []

if show:

    for acm in acms:
        
        """
        # why is this not working...
        for group in robot.group_names:
            if acm.link_name in robot.get_link_names(group):
                break
        frame = robot.forward_kinematics(configuration, group=group, backend="model", link_name=acm.link_name)
        T = Transformation.from_frame_to_frame(Frame.worldXY(), frame)
        mesh = mesh_transformed(acm.collision_mesh.mesh, T)
        M.append(MeshArtist(mesh).draw_mesh()) 
        """
        
        link = robot.model.get_link_by_name(acm.link_name)
        T0 = Transformation.from_frame_to_frame(Frame.worldXY(), link.parent_joint.origin)
        
        joint_names = robot.get_configurable_joint_names()
        joint_state = dict(zip(joint_names, configuration.values))
        transformations = robot.model.compute_transformations(joint_state)
    
        for j in robot.model.iter_joints():
            if j.child_link.name == acm.link_name:
                T = transformations[j.name]
                compas_mesh = acm.collision_mesh.mesh
                mesh = mesh_transformed(compas_mesh, T * T0)
                M.append(MeshArtist(mesh).draw_mesh())
                break
# ---------- end visualize_2 ----------
preview_4 = CustomPreview(Geometry=visualize_2, Shader=ColourSwatch(SwatchColor=RGB(255, 255, 255)))
preview_5 = CustomPreview(Geometry=visualize.ee_frame_geo, Shader=visualize.ee_frame_color)
preview_6 = CustomPreview(Geometry=visualize.base_frame_geo, Shader=visualize.base_frame_color)
preview_7 = CustomPreview(Geometry=visualize.frames, Shader=visualize.frames_color)
geo = Geometry(visualize.visual)
geo_2 = Geometry(visualize.collision)
panel_28 = Panel(visualize.out)
preview_8 = CustomPreview(Geometry=geo, Shader=ColourSwatch(SwatchColor=RGB(105, 105, 105)))
