# Grasshopper definition 20_robot_assembly.ghx (Grasshopper 0.9.76)
# plug-ins: Python Interpreter

# ---- group: ROS client
disconnect = Button()
restart = Button()
connect = Button()
ros = PythonScript(restart=restart, ip="127.0.0.1")  # -> out, ros_client
# ---------- ros: Python ----------
import sys
import time
import logging
import scriptcontext as sc

from compas_fab.backends import RosClient

from System import TimeSpan
from System.Threading import ManualResetEventSlim

LOGGER = logging.getLogger('roslibpy')

key = 'rosclient_%s' % str(ghenv.Component.InstanceGuid)
previous_client = sc.sticky.get(key, None)
if previous_client:
    previous_client.terminate()

ros_client = RosClient(ip, 9090)
sc.sticky[key] = ros_client

waitLock = ManualResetEventSlim(False)

ros_client.on_ready(lambda: waitLock.Set())

if not waitLock.Wait(TimeSpan.FromSeconds(5)):
    raise Exception('Unable to connect to ROS')

LOGGER.info('ROS connection opened')
# ---------- end ros ----------
connect_2 = PythonScript(ros_client=ros.ros_client, connect=connect, disconnect=disconnect)  # -> out, ros_client
# ---------- connect_2: Python ----------
import logging
from System import TimeSpan
from System.Threading import ManualResetEventSlim

LOGGER = logging.getLogger('roslibpy')

if connect:
    if not ros_client.is_connected:
        LOGGER.debug('Connecting...')
        waitLock = ManualResetEventSlim(False)
        ros_client.on_ready(lambda: waitLock.Set())
        ros_client.connect()

        if not waitLock.Wait(TimeSpan.FromSeconds(5)):
            raise Exception('Unable to connect to ROS')
        LOGGER.debug('Reconnected')

if disconnect:
    if ros_client.is_connected:
        ros_client.terminate()
        LOGGER.debug('Terminated')
# ---------- end connect_2 ----------

# ----
reload = Button()

panel = Panel("Load example UR5 robot")
units = ValueList({"m": 1, "cm": 100, "mm": 1000}, selected="m")
load = Button()
create = PythonScript(scale_factor=units, load=load)  # -> robot
# ---------- create: Python ----------
import os
from scriptcontext import sticky as st

import compas
from compas_fab.robots.ur5 import Robot
from compas_fab.ghpython import RobotArtist

compas.PRECISION = '12f'

# store robot in component
guid = str(ghenv.Component.InstanceGuid)
robot_key = "robot_" + guid

if robot_key not in st:
    st[robot_key] = None

if load:
    robot = Robot(load_geometry=True)
    robot.artist = RobotArtist(robot.model)
    st[robot_key] = robot
    robot.scale(scale_factor)

robot = st[robot_key]
# ---------- end create ----------
robot = Data(create)

# ----
# Tool
panel_2 = Panel("Set a custom tool")
show = BooleanToggle(False)
py = PythonScript()  # -> HERE, DATA
# ---------- py: Python ----------
import os

HERE = os.path.dirname(ghdoc.Path)
DATA = os.path.abspath(os.path.join(HERE, "..", "data"))
print(HERE)
print(DATA)
# ---------- end py ----------
python = PythonScript(path=py.DATA, filename="vacuum_gripper.stl", show=show)  # -> tool, M
# ---------- python: Python ----------
import os
from compas.geometry import Frame
from compas.datastructures import Mesh
from compas_ghpython.artists import MeshArtist
from compas_fab.robots import Tool

fullfilename = os.path.join(path, filename)
ee_mesh = Mesh.from_stl(fullfilename)
ee_frame = Frame([0.07, 0, 0], [0, 0, 1], [0, 1, 0])

if show:
    artist = MeshArtist(ee_mesh)
    M = artist.draw_mesh()

tool = Tool(ee_mesh, ee_frame)
# ---------- end python ----------
attach = BooleanToggle(True)
py_2 = PythonScript(robot=robot, tool=python.tool, attach=attach)
# ---------- py_2: Python ----------
if attach:
    robot.attach_tool(tool)
else:
    robot.detach_tool()
# ---------- end py_2 ----------

# ----
# Assembly
panel_3 = Panel("Brick: collision object")
py_3 = PythonScript()  # -> HERE, DATA; same code as py

# ----
# Settings
number_slider = Slider(0.06, range=0..0.1)
save = Button()
python_2 = PythonScript(
    robot=robot,
    width=number_slider,
    length=Slider(0.03, range=0..0.1),
    height=Slider(0.014, range=0..0.1),
    DATA=py_3.DATA,
    filename="settings.json",
    save=save)  # -> out, settings_file
# ---------- python_2: Python ----------
import os
import sys
import json

from compas.geometry import Frame
from compas.geometry import Vector
from compas.geometry import Box
from compas_fab.robots import Configuration

sys.path.append(os.path.abspath(os.path.join(DATA, "..")))
from assembly import Element

dimensions = width, length, height

tolerance_vector = Vector(0, 0, 0.001)
savelevel_vector = Vector(0, 0, 0.05)

picking_frame = Frame([-0.43, 0, height], [1, 0, 0], [0, 1, 0])
picking_configuration = Configuration.from_revolute_values([-6.027, 4.443, -2.313, 5.724, 1.571, -2.885])

# brick
box_frame = Frame([-width/2., -length/2, 0], [1, 0, 0], [0, 1, 0])
box = Box(box_frame, width, length, height)
gripping_frame = Frame([0, 0, height], [1, 0, 0], [0, 1, 0])
brick = Element.from_shape(box, gripping_frame)

# halfbrick
box_frame = Frame([-width/4., -length/2, 0], [1, 0, 0], [0, 1, 0])
box = Box(box_frame, width/2, length, height)
gripping_frame = Frame([0, 0, height], [1, 0, 0], [0, 1, 0])
halfbrick = Element.from_shape(box, gripping_frame)

if robot and robot.client and robot.client.is_connected:
    
    picking_frame_tolerance = picking_frame.copy()
    picking_frame_tolerance.point += tolerance_vector
    frame_tool0 = robot.from_attached_tool_to_tool0([picking_frame_tolerance])[0]
    picking_configuration = robot.inverse_kinematics(frame_tool0, picking_configuration)
    print("Setting new picking configuration:")
    print(picking_configuration)

data = {}
data['brick_dimensions'] = dimensions
data['tolerance_vector'] = tolerance_vector.data
data['savelevel_vector'] = savelevel_vector.data
data['picking_frame'] = Frame([-0.43, 0, height], [1, 0, 0], [0, 1, 0]).data
data['picking_configuration'] = Configuration.from_revolute_values([-6.027, 4.443, -2.313, 5.724, 1.571, -2.885]).data
data['brick'] = brick.data
data['halfbrick'] = halfbrick.data

settings_file = os.path.join(DATA, filename)

if save:
    with open(settings_file, 'w') as f:
        json.dump(data, f, sort_keys=True, indent=4)
    print("Saved json file to %s" % settings_file)
# ---------- end python_2 ----------
panel_4 = Panel(python_2.out)

py_4 = PythonScript(reload=reload)
# ---------- py_4: Python ----------
import os
import sys
from compas_rhino.utilities.misc import get_tolerance
from compas_rhino.utilities.misc import unload_modules

from compas_ghpython import unload_modules
unload_modules("compas")
unload_modules("compas_fab")
unload_modules("roslibpy")
unload_modules("assembly")

HERE = os.path.dirname(ghdoc.Path)
DATA = os.path.abspath(os.path.join(HERE, "..", "data"))
ASSEMBLY_PATH = os.path.abspath(os.path.join(HERE, ".."))
sys.path.append(ASSEMBLY_PATH)
# ---------- end py_4 ----------
panel_5 = Panel("C:\Users\rustr\workspace\teaching\Assignment-RA2\data\flemish_bond.json")

# ----
# Robot
set = PythonScript(robot=robot, client=connect_2.ros_client)
# ---------- set: Python ----------
if robot and client:
    robot.client = client
# ---------- end set ----------

panel_6 = Panel("Load assembly")

# ----
# Info
info = PythonScript(robot=robot)  # -> out, main_group_name
# ---------- info: Python ----------
if robot:
    robot.info()
    main_group_name = robot.main_group_name
# ---------- end info ----------
panel_7 = Panel(info.out)

assembly = PythonScript(DATA=py_3.DATA, filepath=panel_5)  # -> assembly
# ---------- assembly: Python ----------
import os
import sys
sys.path.append(os.path.abspath(os.path.join(DATA, "..")))

from assembly import Assembly

#filepath = os.path.join(DATA, filename)

assembly = Assembly.from_json(filepath)
# ---------- end assembly ----------
assembly_2 = PythonScript(DATA=py_3.DATA, filename="27_strecher_bond.json")  # -> assembly
# ---------- assembly_2: Python ----------
import os
import sys
sys.path.append(os.path.abspath(os.path.join(DATA, "..")))

from assembly import Assembly

filepath = os.path.join(DATA, filename)

assembly = Assembly.from_json(filepath)
# ---------- end assembly_2 ----------
show_2 = BooleanToggle(True)
show_3 = BooleanToggle(True)
draw = PythonScript(DATA=py_3.DATA, assembly=assembly, show=show_2)  # -> G
# ---------- draw: Python ----------
import os
import sys
sys.path.append(os.path.abspath(os.path.join(DATA, "..")))

from assembly import AssemblyArtist

if show:
    artist = AssemblyArtist(assembly)
    G = artist.draw()
# ---------- end draw ----------
draw_2 = PythonScript(DATA=py_3.DATA, assembly=assembly_2, show=show_3)  # -> G; same code as draw
preview = CustomPreview(Geometry=draw, Shader=ColourSwatch(SwatchColor=RGBA(201, 145, 71, 218)))
preview_2 = CustomPreview(Geometry=draw_2, Shader=ColourSwatch(SwatchColor=RGBA(201, 145, 71, 218)))

# ----
# Configuration
main_planning_group = Text(info.main_group_name)

# ---- group: inverse kinematics
pt = Point(Point(-0.4465622192, -0.03378897922, 0.01223345896))
py_5 = PythonScript(robot=robot)  # -> configuration
# ---------- py_5: Python ----------
from compas_fab.robots import Configuration

if robot:
    types = robot.get_configurable_joint_types()
    values = [0] * len(types)
    values = [-0.042, 4.295, -4.110, -3.327, 4.755, 0.]

    configuration = Configuration(values, types)
    print configuration
# ---------- end py_5 ----------
xy = XYPlane(Origin=pt)
python_3 = PythonScript(robot=robot, plane=xy)  # -> out, frame
# ---------- python_3: Python ----------
from compas.geometry import Frame
frame = Frame(plane.Origin, plane.XAxis, plane.YAxis)
frame = robot.from_attached_tool_to_tool0([frame])[0]
# ---------- end python_3 ----------
ik = PythonScript(robot=robot, group=main_planning_group, start_configuration=py_5, frame=python_3.frame)  # -> out, configuration
# ---------- ik: Python ----------
import scriptcontext as sc
import logging

from compas.geometry import Frame

from compas_fab.backends.ros import RosError
from compas_fab.robots import Configuration

LOGGER = logging.getLogger('roslibpy')

guid = str(ghenv.Component.InstanceGuid)
response_key = "response_" + guid

if response_key not in sc.sticky:
    sc.sticky[response_key] = None

if robot:
    if robot.client:
        if robot.client.is_connected:
            response = robot.inverse_kinematics(frame, start_configuration, group)
            sc.sticky[response_key] = response
        else:
            print("Robot is not connected")

if sc.sticky[response_key]:
    response = sc.sticky[response_key]
    configuration = response
# ---------- end ik ----------
panel_8 = Panel(ik.out)

# ---- group: forward kinematics
a1 = Slider(-208, range=-360..360)
a6 = Slider(-165, range=-360..360)
a2 = Slider(255, range=-360..360)
a4 = Slider(328, range=-360..360)
a5 = Slider(90, range=-360..360)
a3 = Slider(-133, range=-360..360)
set_joint_positions = BooleanToggle(False)
jp = GhPythonScript()  # -> joint_positions
# ---------- jp: Python ----------
import math
joint_positions = [-3.136, -0.328, -1.218, 3.129, 0.852, 0.008]
joint_positions = [0] * 6
joint_positions = [-6.027, 4.443, -2.313, 5.724, 1.571, -2.885]
print joint_positions
# ---------- end jp ----------
forward_kinematics = PythonScript(
    robot=robot,
    group=main_planning_group,
    set_joint_positions=set_joint_positions,
    joint_positions=jp,
    a1=a1,
    a2=a2,
    a3=a3,
    a4=a4,
    a5=a5,
    a6=a6)  # -> configuration; inputs joint_positions: list
# ---------- forward_kinematics: Python ----------
import math
import Grasshopper
from compas_fab.robots import Configuration

if set_joint_positions:

    j = 0
    for i in range(ghenv.Component.Params.Input.Count):
        nslider = ghenv.Component.Params.Input[i].Sources[0]
        if nslider.GetType() == Grasshopper.Kernel.Special.GH_NumberSlider:
            nslider.TrySetSliderValue(math.degrees(joint_positions[j]))
            j += 1

if robot:
    joint_positions = [a1, a2, a3, a4, a5, a6]
    joint_positions = [math.radians(a) for a in joint_positions]
    types = robot.get_configurable_joint_types(group)
    configuration = Configuration(joint_positions, types)
    print configuration
# ---------- end forward_kinematics ----------

# ----
list = ValueList({"RRT", "RRT*": "RRTStar", "EST", "PRM": "RPM", "PRM*": "RPMStar", "SPARS"}, selected="RRT")

# ---- group: forward kinematics
fk = PythonScript(robot=robot, group=main_planning_group, configuration=ik.configuration)  # -> out, frame_WCF
# ---------- fk: Python ----------
import scriptcontext as sc
import logging
import Rhino

from compas_fab.robots import Configuration

LOGGER = logging.getLogger('roslibpy')

guid = str(ghenv.Component.InstanceGuid)
response_key = "response_" + guid

if response_key not in sc.sticky:
    sc.sticky[response_key] = None

if robot:
    if robot.client:
        if robot.client.is_connected:
            configuration = robot.get_group_configuration(group, configuration)
            sc.sticky[response_key] = robot.forward_kinematics(configuration, group, backend='model')
        else:
            print("Robot is not connected")

if sc.sticky[response_key]:
    frame_RCF = sc.sticky[response_key]
    frame_WCF = robot.to_world_coords(frame_RCF, group)

print frame_WCF
# ---------- end fk ----------
panel_9 = Panel(fk.out)

# ----
reset = Button()
start = Button()

# ----
# Planning scene
# Pass collision objects to planning scene
scene = PythonScript(robot=robot)  # -> scene
# ---------- scene: Python ----------
from scriptcontext import sticky as st

from compas_fab.robots import PlanningScene

# store scene in component
guid = str(ghenv.Component.InstanceGuid)
scene_key = "scene_" + guid

if scene_key not in st:
    st[scene_key] = None

if robot:
    st[scene_key] = PlanningScene(robot)

scene = st[scene_key]
# ---------- end scene ----------

panel_10 = Panel("Define an obstacle")
brep = Brep(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)
mesh = Mesh(brep)
preview_3 = CustomPreview(Geometry=brep, Shader=ColourSwatch(SwatchColor=RGB(255, 255, 255)))
mesh_2 = PythonScript(mesh=mesh)  # -> compas_mesh
# ---------- mesh_2: Python ----------
from compas.datastructures import Mesh
from compas_rhino.helpers import mesh_from_guid

compas_mesh = mesh_from_guid(Mesh, mesh)
# ---------- end mesh_2 ----------
remove = Button()
scale = BooleanToggle(False)
add = Button()
collision = PythonScript(scene=scene, compas_mesh=mesh_2, scale=scale, id="floor", add=add, remove=remove)  # -> out
# ---------- collision: Python ----------
from compas_fab.robots import CollisionMesh

cm = CollisionMesh(compas_mesh, id)

if scene:
    if add:
        scene.add_collision_mesh(cm, scale)
    if remove:
        scene.remove_collision_mesh(id)
# ---------- end collision ----------
panel_11 = Panel(collision)

# ----
# Add or remove tool
remove_2 = Button()
add_2 = Button()
tool = PythonScript(scene=scene, add=add_2, remove=remove_2)  # -> out, a
# ---------- tool: Python ----------
if scene:
    if add:
        scene.add_attached_tool()
    if remove:
        scene.remove_attached_tool()
# ---------- end tool ----------

# ----
# Attach an collision object
remove_3 = Button()
add_3 = Button()

# ----
# Bricks
brick = PythonScript(DATA=py_3.DATA, settings_file=python_2.settings_file)  # -> brick, halfbrick
# ---------- brick: Python ----------
import sys
import os
import json
sys.path.append(os.path.abspath(os.path.join(DATA, "..")))

from assembly import Element

with open(settings_file, 'r') as f:
    data = json.load(f)

brick = Element.from_data(data['brick'])
halfbrick = Element.from_data(data['halfbrick'])
# ---------- end brick ----------
show_4 = BooleanToggle(True)
show_5 = BooleanToggle(True)
py_6 = PythonScript(elem=brick.brick, show=show_5)  # -> F, M
# ---------- py_6: Python ----------
from compas_ghpython.artists import MeshArtist

if show:
    artist = MeshArtist(elem.mesh)
    M = artist.draw_mesh()
    F = elem.gripping_frame
# ---------- end py_6 ----------
py_7 = PythonScript(elem=brick.halfbrick, show=show_4)  # -> F, M; same code as py_6
show_6 = BooleanToggle(False)
draw_3 = Draw(frames=[py_7.F, py_6.F])  # -> G, S
preview_4 = CustomPreview(Geometry=draw_3.G, Shader=draw_3.S)

python_4 = PythonScript(robot=robot, brick=brick.brick)  # -> brick_acm
# ---------- python_4: Python ----------
from compas.geometry import Transformation
from compas_fab.robots import CollisionMesh, AttachedCollisionMesh

brick_tool0 = brick.copy()
T = Transformation.from_frame_to_frame(brick_tool0.gripping_frame, robot.attached_tool.frame)
brick_tool0.transform(T)
ee_link_name = robot.get_end_effector_link_name()
brick_acm = AttachedCollisionMesh(CollisionMesh(brick_tool0.mesh, 'brick'), ee_link_name)
# ---------- end python_4 ----------

attached = PythonScript(scene=scene, acm=python_4, add=add_3, remove=remove_3)  # -> out, acm
# ---------- attached: Python ----------
from compas_fab.robots import CollisionMesh
from compas_fab.robots import AttachedCollisionMesh

id = acm.collision_mesh.id

if scene:
    if add:
        scene.add_attached_collision_mesh(acm)
    if remove:
        scene.remove_attached_collision_mesh(id)
        scene.remove_collision_mesh(id)
# ---------- end attached ----------

# ----
# Assembly
panel_12 = Panel("26_pick_and_place_stack.json")
panel_14 = Panel("Create assembly")
pt_2 = Point(Point(-0.26, -0.28, 0))
stack = PythonScript(HERE=py_3.HERE, brick=brick.brick, num=Slider(7, range=1..10), origin=pt_2)  # -> assembly; inputs num: Int32
# ---------- stack: Python ----------
import sys
import os
import math
sys.path.append(os.path.abspath(os.path.join(HERE, "..")))

from compas.datastructures import Mesh
from compas.geometry import Transformation, Translation, Box, Frame, Rotation
from compas_ghpython.artists import MeshArtist

from assembly import Assembly
from assembly import Element

width = brick._source.width
height = brick._source.height
length = brick._source.depth

assembly = Assembly()

for i in range(num):
    dy = i * height
    block = brick.copy()
    block.transform(Translation([0, 0, dy]))
    print(block.data)
    assembly.add_element(block)

T = Translation(list(origin))
assembly.transform(T)
# ---------- end stack ----------
assembly_3 = PythonScript(DATA=py_3.DATA, filename=panel_12)  # -> assembly; same code as assembly_2
show_7 = BooleanToggle(True)
show_8 = BooleanToggle(False)
draw_4 = PythonScript(DATA=py_3.DATA, assembly=assembly_3, show=show_7)  # -> G; same code as draw
draw_5 = PythonScript(DATA=py_3.DATA, assembly=stack, show=show_8)  # -> G; same code as draw
assembly_4 = Data(assembly)
preview_5 = CustomPreview(Geometry=draw_4, Shader=ColourSwatch(SwatchColor=RGBA(201, 145, 71, 218)))
preview_6 = CustomPreview(Geometry=draw_5, Shader=ColourSwatch(SwatchColor=RGBA(201, 145, 71, 218)))

# ----
# Settings
python_5 = PythonScript(settings_file=python_2.settings_file, brick=brick.brick)  # -> picking_frame, savelevel_picking_frame, picking_configuration, savelevel_vector, tolerance_vector, M
# ---------- python_5: Python ----------
import json

from compas.geometry import Frame
from compas.geometry import Vector
from compas_fab.robots import Configuration
from compas.geometry import Transformation
from compas_ghpython.artists import MeshArtist

with open(settings_file, 'r') as f:
    data = json.load(f)

dimensions = data['brick_dimensions']
tolerance_vector = Vector.from_data(data['tolerance_vector'])
savelevel_vector = Vector.from_data(data['savelevel_vector'])
picking_frame = Frame.from_data(data['picking_frame'])
picking_configuration = Configuration.from_data(data['picking_configuration'])

savelevel_picking_frame = picking_frame.copy()

picking_frame.point += tolerance_vector
savelevel_picking_frame.point += savelevel_vector

brick_at_picking_frame = brick.transformed(Transformation.from_frame_to_frame(brick.gripping_frame, picking_frame))
artist = MeshArtist(brick_at_picking_frame.mesh)
M = artist.draw_mesh()
# ---------- end python_5 ----------
preview_7 = CustomPreview(Geometry=python_5.M, Shader=ColourSwatch(SwatchColor=RGBA(201, 145, 71, 218)))
draw_6 = Draw(frames=[python_5.picking_frame, python_5.savelevel_picking_frame])  # -> G, S
preview_8 = CustomPreview(Geometry=draw_6.G, Shader=draw_6.S)

# ----
# Step
number_slider_2 = Slider(74, range=0..100)
python_6 = PythonScript(assembly=assembly_4, key=number_slider_2)  # -> out, brick, M; inputs key: Int32
# ---------- python_6: Python ----------
from compas_ghpython.artists import MeshArtist


brick = assembly.element(key)

artist = MeshArtist(brick.mesh)
M = artist.draw_mesh()
# ---------- end python_6 ----------
preview_9 = CustomPreview(Geometry=python_6.M, Shader=ColourSwatch(SwatchColor=RGBA(255, 0, 0, 218)))
brick_2 = Data(python_6.brick)
python_7 = PythonScript(robot=robot, brick=brick_2, savelevel_vector=python_5.savelevel_vector, tolerance_vector=python_5.tolerance_vector)  # -> out, brick, brick_acm, savelevel_target_frame, target_frame
# ---------- python_7: Python ----------
from compas.geometry import Transformation
from compas_fab.robots import CollisionMesh, AttachedCollisionMesh

brick_tool0 = brick.copy()
T = Transformation.from_frame_to_frame(brick_tool0.gripping_frame, robot.attached_tool.frame)
brick_tool0.transform(T)
ee_link_name = robot.get_end_effector_link_name()
brick_acm = AttachedCollisionMesh(CollisionMesh(brick_tool0.mesh, 'brick'), ee_link_name)


target_frame = brick.gripping_frame
target_frame.point += tolerance_vector
savelevel_target_frame = target_frame.copy()
savelevel_target_frame.point += savelevel_vector
# ---------- end python_7 ----------
draw_7 = Draw(frames=[python_7.savelevel_target_frame, python_7.target_frame])  # -> G, S
preview_10 = CustomPreview(Geometry=draw_7.G, Shader=draw_7.S)

# ---- group: cartesian motion
# 6. Save assembly to json
panel_15 = Panel("assembly_stack_planned.json")
save_2 = Button()
python_8 = PythonScript(assembly=assembly_4, DATA=py_3.DATA, name=panel_15, save=save_2)  # -> out, a
# ---------- python_8: Python ----------
import os
filename = os.path.join(DATA, name)


print assembly.element(0)

if save:
    assembly.to_json(filename, pretty=True)
# ---------- end python_8 ----------

# 1. 'Pick' cartesian motion
number_slider_3 = Slider(0.01, range=0..0.01)
python_9 = PythonScript(robot=robot, frames=[python_5.picking_frame, python_5.savelevel_picking_frame])  # -> frames_tool0; inputs frames: list
# ---------- python_9: Python ----------
from compas.geometry import Frame

frames_tool0 = robot.from_attached_tool_to_tool0(frames)
# ---------- end python_9 ----------
start_configuration = Data(python_5.picking_configuration)
compute = Button()
plan_cartesian_motion = PythonScript(
    robot=robot,
    start_configuration=start_configuration,
    frames=python_9,
    max_step=number_slider_3,
    compute=compute,
    acm=python_7.brick_acm)  # -> out, response; inputs frames: list, acm: list
# ---------- plan_cartesian_motion: Python ----------
import logging
import scriptcontext as sc

from compas.geometry import Frame

from compas_ghpython.utilities import update_component

guid = str(ghenv.Component.InstanceGuid)
response_key = "response_" + guid
if response_key not in sc.sticky:
    sc.sticky[response_key] = None

LOGGER = logging.getLogger('roslibpy')
data = dict(requesting_solution=False)

if robot:
    if robot.client:
        if robot.client.is_connected:
            if start_configuration and compute:
                response = robot.plan_cartesian_motion(frames, start_configuration=start_configuration,
                                             max_step=float(max_step),
                                             group=group,
                                             attached_collision_meshes=list(acm))
                sc.sticky[response_key] = response
                # update_component(ghenv, 100)  # Not needed now that it is sync?
        else:
            print("Robot is not connected")
            sc.sticky[response_key] = None

response = sc.sticky[response_key]
# ---------- end plan_cartesian_motion ----------
py_8 = PythonScript(response=plan_cartesian_motion.response)  # -> start_configuration, configurations, fraction, time
# ---------- py_8: Python ----------
from compas_fab.backends.ros import MoveItErrorCodes

joint_positions = []

if response:
    #if response.error_code == MoveItErrorCodes.SUCCESS:
    configurations = response.points
    start_configuration = response.start_configuration
    fraction = response.fraction
    time = response.time_from_start
# ---------- end py_8 ----------
fraction = Panel(py_8.fraction)
panel_16 = Panel(plan_cartesian_motion.out)
time_s = Panel(py_8.time)
vis = PythonScript(response=plan_cartesian_motion.response)  # -> P, V, A
# ---------- vis: Python ----------
from compas_ghpython import list_to_ghtree

if response:

    positions = []
    velocities = []
    accelerations = []

    for p in response.points:
        positions.append(p.positions)
        velocities.append(p.velocities)
        accelerations.append(p.accelerations)

    P = list_to_ghtree(list(zip(*positions)))
    V = list_to_ghtree(list(zip(*velocities)))
    A = list_to_ghtree(list(zip(*accelerations)))
# ---------- end vis ----------
prismatic = QuickGraph(vis.P)
panel_17 = Panel("positions")
animate = PythonScript(
    robot=robot,
    start_configuration=py_8.start_configuration,
    configurations=py_8.configurations,
    value=Slider(1, range=0..1))  # -> configuration; inputs configurations: list
# ---------- animate: Python ----------
from compas_fab.utilities import map_range
from compas_fab.robots import Configuration

count = len(configurations)
if count and robot and configurations != [None]:
    idx = int(map_range(value, 0, 1, 0, count - 1))
    current_configuration = configurations[idx]
    #make full configuration
    configuration = robot.merge_group_with_full_configuration(current_configuration, start_configuration, group)
# ---------- end animate ----------
graph = QuickGraph(vis.A)
graph_2 = QuickGraph(vis.V)
panel_18 = Panel("velocities")
panel_19 = Panel("accelerations")

# 4. Append brick to planning scene
panel_20 = Panel("brick_wall")
remove_4 = Button()
append = Button()
collision_2 = PythonScript(scene=scene, brick=python_7.brick, id=panel_20, append=append, remove=remove_4)  # -> out
# ---------- collision_2: Python ----------
from compas_fab.robots import CollisionMesh

if scene:
    if append:
        cm = CollisionMesh(brick.mesh, id)
        scene.append_collision_mesh(cm)
    if remove:
        scene.remove_collision_mesh(id)
# ---------- end collision_2 ----------
panel_21 = Panel(collision_2)

# ----
py_9 = PythonScript(configurations=py_8.configurations)  # -> last_configuration; inputs configurations: list
# ---------- py_9: Python ----------
if len(configurations):
    last_configuration = configurations[-1]
# ---------- end py_9 ----------

# ---- group: plan motion
# 2. 'Move' free-space motion
number_slider_4 = Slider(1, range=1..360)
python_10 = PythonScript(
    robot=robot,
    group=main_planning_group,
    savelevel_target_frame=python_7.savelevel_target_frame,
    tolerance_position=Slider(0.001, range=0..0.001),
    tolerance_xaxis_deg=Slider(1, range=1..360),
    tolerance_yaxis_deg=Slider(1, range=1..360),
    tolerance_zaxis_deg=number_slider_4)  # -> goal_constraints
# ---------- python_10: Python ----------
import math
from compas.geometry import Frame

target_frame_tool0 = robot.from_attached_tool_to_tool0([savelevel_target_frame])[0]

tolerances_axes = [math.radians(tolerance_xaxis_deg), math.radians(tolerance_yaxis_deg), math.radians(tolerance_zaxis_deg)]

if robot:
    goal_constraints = robot.constraints_from_frame(target_frame_tool0, tolerance_position, tolerances_axes, group)
# ---------- end python_10 ----------
compute_2 = Button()
plan_motion = PythonScript(
    robot=robot,
    start_configuration=py_9,
    goal_constraints=python_10,
    planner_id=list,
    compute=compute_2,
    acm=python_7.brick_acm)  # -> out, response; inputs goal_constraints: list, path_constraints: list, acm: list
# ---------- plan_motion: Python ----------
import logging
from scriptcontext import sticky as st
import math
from compas.geometry import Frame

from compas_fab.robots import Configuration

from compas_ghpython.utilities import update_component

guid = str(ghenv.Component.InstanceGuid)
response_key = "response_" + guid
if response_key not in st:
    st[response_key] = None

LOGGER = logging.getLogger('roslibpy')
data = dict(requesting_solution=False)

path_constraints = list(path_constraints)
if not len(path_constraints):
    path_constraints = None
    

if robot and robot.client and robot.client.is_connected and start_configuration and compute:
    st[response_key] = robot.plan_motion(goal_constraints,
                                         start_configuration,
                                         group,
                                         planner_id=str(planner_id),
                                         path_constraints=path_constraints,
                                         attached_collision_meshes=list(acm))

response = st[response_key]
# ---------- end plan_motion ----------
vis_2 = PythonScript(response=plan_motion.response)  # -> P, V, A, time
# ---------- vis_2: Python ----------
from compas_ghpython import list_to_ghtree

if response:

    positions = []
    velocities = []
    accelerations = []
    time_from_start = []

    for p in response.points:
        positions.append(p.positions)
        velocities.append(p.velocities)
        accelerations.append(p.accelerations)
        time_from_start.append(p.time_from_start.seconds)

    P = list_to_ghtree(list(zip(*positions)))
    V = list_to_ghtree(list(zip(*velocities)))
    A = list_to_ghtree(list(zip(*accelerations)))

    time = time_from_start[-1]
    print time
# ---------- end vis_2 ----------
time_s_2 = Panel(vis_2.time)
prismatic_2 = QuickGraph(vis_2.P)
panel_22 = Panel(plan_motion.out)
py_10 = PythonScript(robot=robot, response=plan_motion.response)  # -> start_configuration, configurations
# ---------- py_10: Python ----------
from compas_fab.backends.ros import MoveItErrorCodes
from compas_fab.robots import Configuration
joint_positions = []

if response:
    #if response.error_code == MoveItErrorCodes.SUCCESS:
    print response.start_configuration
    print response.planning_time

    configurations = response.points
    start_configuration = response.start_configuration
    #error = response.error_code.human_readable




print start_configuration
# ---------- end py_10 ----------
graph_3 = QuickGraph(vis_2.V)
graph_4 = QuickGraph(vis_2.A)
animate_2 = PythonScript(
    robot=robot,
    start_configuration=py_10.start_configuration,
    configurations=py_10.configurations,
    value=Slider(1, range=0..1))  # -> configuration; inputs configurations: list; same code as animate

# ---- group: cartesian motion
# 3. 'Place' cartesian motion
py_11 = PythonScript(configurations=py_10.configurations)  # -> last_configuration; inputs configurations: list; same code as py_9
python_11 = PythonScript(robot=robot, frames=[python_7.savelevel_target_frame, python_7.target_frame])  # -> frames_tool0; inputs frames: list; same code as python_9
compute_3 = Button()
plan_cartesian_motion_2 = PythonScript(
    robot=robot,
    start_configuration=py_11,
    frames=python_11,
    max_step=Slider(0.01, range=0..0.01),
    compute=compute_3,
    acm=python_7.brick_acm)  # -> out, response; inputs frames: list, acm: list; same code as plan_cartesian_motion
py_12 = PythonScript(response=plan_cartesian_motion_2.response)  # -> start_configuration, configurations, fraction, time; same code as py_8
fraction_2 = Panel(py_12.fraction)
panel_26 = Panel(plan_cartesian_motion_2.out)
time_s_3 = Panel(py_12.time)
vis_3 = PythonScript(response=plan_cartesian_motion_2.response)  # -> P, V, A; same code as vis
prismatic_3 = QuickGraph(vis_3.P)
animate_3 = PythonScript(
    robot=robot,
    start_configuration=py_12.start_configuration,
    configurations=py_12.configurations,
    value=Slider(0, range=0..1))  # -> configuration; inputs configurations: list; same code as animate
graph_5 = QuickGraph(vis_3.A)
graph_6 = QuickGraph(vis_3.V)

# 5. Add trajectories to element and set to 'planned'
python_12 = PythonScript(
    assembly=assembly_4,
    key=number_slider_2,
    trajectory1=plan_cartesian_motion.response,
    trajectory2=plan_motion.response,
    trajectory3=plan_cartesian_motion_2.response)  # -> out, a; inputs key: Int32
# ---------- python_12: Python ----------
element = assembly.element(key)
element.trajectory = [trajectory1, trajectory2, trajectory3]
assembly.network.set_vertex_attribute(key, 'is_planned', True)
# ---------- end python_12 ----------

# ----
python_13 = PythonScript(trajectory1=py_8.configurations, trajectory2=py_10.configurations, trajectory3=py_12.configurations)  # -> trajectory; inputs trajectory1: list, trajectory2: list, trajectory3: list
# ---------- python_13: Python ----------
trajectory = []

if trajectory1 != [None]:
    trajectory += trajectory1

if trajectory2 != [None]:
    trajectory += trajectory2

if trajectory3 != [None]:
    trajectory += trajectory3
# ---------- end python_13 ----------
counter = CountThroughList(L=python_13, start=start, stop=False, step=False, reset=reset, interval=100)  # -> item; inputs L: list, start: Boolean, stop: Boolean
# ---------- counter: Python ----------
from scriptcontext import sticky as st
from compas_ghpython.utilities import update_component

if not interval:
    interval = 5

# store data in component
guid = str(ghenv.Component.InstanceGuid)
counter_key = "counter_" + guid
running_key = "running_" + guid

if counter_key not in st:
    st[counter_key] = 0

if running_key not in st:
    st[running_key] = False

if start:
    st[running_key] = True

if stop:
    st[running_key] = False

if step:
    if st[counter_key] < len(L) - 1:
        st[counter_key] += 1

if back:
    if st[counter_key] > 1:
        st[counter_key] -= 1
    
if len(L):
    item = L[st[counter_key]]

if st[running_key]:
    if st[counter_key] < len(L) - 1:
        st[counter_key] += 1
        update_component(ghenv, interval)
    else:
        st[counter_key] = 0
        st[running_key] = False
# ---------- end counter ----------

# ----
# Visualisation
# Select configuration input: from fk, ik, path, or from real robot
list_2 = ValueList({"0 forward_kinematics": 0, "1 'pick_and_place'": 1}, selected="1 'pick_and_place'")
filter = StreamFilter(Gate=list_2, Stream0=forward_kinematics, Stream1=counter)
show_end_effector_frame = BooleanToggle(True)
show_base_frame = BooleanToggle(False)
show_collision = BooleanToggle(False)
show_frames = BooleanToggle(False)
show_visual = BooleanToggle(True)
visualize = PythonScript(
    robot=robot,
    configuration=filter,
    show_visual=show_visual,
    show_collision=show_collision,
    show_end_effector_frame=show_end_effector_frame,
    show_frames=show_frames,
    show_base_frame=show_base_frame)  # -> out, robot, visual, collision, frames, ee_plane, ee_frame, base_plane, base_frame
# ---------- visualize: Python ----------
from compas_ghpython.utilities import draw_frame
from compas_fab.robots import Configuration

if robot and configuration:

    robot.artist.update(configuration, robot.get_configurable_joint_names(), visual=show_visual, collision=show_collision)

    print("Configuration:")
    print(configuration.values)
    
    axes = robot.transformed_axes(configuration)

    if show_frames:
        frames = robot.transformed_frames(configuration)

    ee_frame_RCF = robot.forward_kinematics(configuration, backend='model')
    ee_frame = robot.to_world_coords(ee_frame_RCF)
    ee_plane = draw_frame(ee_frame)

    print("End-effector frame:")
    print(ee_frame)
    
    if show_visual:
        visual = robot.draw_visual()

    if robot.attached_tool:
        ee_frame = robot.from_tool0_to_attached_tool([ee_frame])[0]

    if show_collision:
        collision = robot.draw_collision()

    base_frame = robot.get_base_frame()
    base_plane = draw_frame(base_frame)

if not show_end_effector_frame:
    ee_frame = None

if not show_base_frame:
    base_frame = None
# ---------- end visualize ----------
panel_30 = Panel(visualize.ee_plane)
draw_8 = PythonScript(robot=visualize.robot, frames=[visualize.frames, visualize.ee_frame, visualize.base_frame])  # -> G, S; inputs frames: list
# ---------- draw_8: Python ----------
from compas.geometry import Vector
from compas.geometry import Point

from compas_ghpython.utilities import draw_pipes
from System.Drawing import Color

red = Color.FromArgb(255, 0, 0)
green = Color.FromArgb(0, 255, 0)
blue = Color.FromArgb(0, 0, 255)

frame_colors = [red, green, blue]

# TODO: move to frame artist?
def pipes_from_frame(frame, size, radius):
    pipes = []
    for axis in [frame.xaxis, frame.yaxis, frame.zaxis]:
        pipe = {}
        pipe['points'] = [list(frame.point), list(Point(*frame.point) + Vector(*axis) * size)]
        pipe['radius'] = radius
        pipes.append(pipe)
    return pipes


pipe_size = 0.1 * robot.scale_factor
pipe_radius = 0.001 * robot.scale_factor
    

pipes = []
frames_color = []
for frame in frames:
    if not frame:
        continue
    pipes += pipes_from_frame(frame, pipe_size, pipe_radius)
    frames_color += frame_colors
    
G = draw_pipes(pipes, cap=1)
S = frames_color
# ---------- end draw_8 ----------
geo = Geometry(visualize.collision)
geo_2 = Geometry(visualize.visual)
preview_11 = CustomPreview(Geometry=draw_8.G, Shader=draw_8.S)
preview_12 = CustomPreview(Geometry=geo_2, Shader=ColourSwatch(SwatchColor=RGB(105, 105, 105)))

python_14 = PythonScript(ee_frame=visualize.ee_frame, brick=brick.brick, show=show_6)  # -> M
# ---------- python_14: Python ----------
from compas.geometry import Transformation
from compas.geometry import Frame
from compas.datastructures import mesh_transformed
from compas_ghpython.artists import MeshArtist

T = Transformation.from_frame_to_frame(brick.gripping_frame, ee_frame)
brick_tool0 = brick.transformed(T)

if show:
    artist = MeshArtist(brick_tool0.mesh)
    M = artist.draw_mesh()
# ---------- end python_14 ----------

# ==== cluster Draw
frames = ClusterInput()
draw = PythonScript(frames=frames)  # -> G, S; inputs frames: list
# ---------- draw: Python ----------
from System.Drawing import Color
from compas_ghpython import draw_lines
from compas_ghpython.utilities import draw_pipes

red = Color.FromArgb(255, 0, 0)
green = Color.FromArgb(0, 255, 0)
blue = Color.FromArgb(0, 0, 255)

frame_colors = [red, green, blue]
size = 0.07
radius = 0.0005

lines = []
pipes = []
frames_colors = []

for frame in frames: 

    for axis in [frame.xaxis, frame.yaxis, frame.zaxis]:
        line = {'start': list(frame.point), 'end': list(frame.point + axis * size)}
        lines.append(line)
        
        points = [line['start'], line['end']]
        pipe = {'points': points, 'radius': radius}
        pipes.append(pipe)
    frames_colors += frame_colors
        

#G = draw_lines(lines)
G = draw_pipes(pipes)
S = frames_colors
# ---------- end draw ----------
G = ClusterOutput(draw.G)
S = ClusterOutput(draw.S)
